vi "DCVRATIOGUI_eventcontrol.gvi"   [LabVIEW NXG 5.1.0]
panel controls:
  "VoltageDC_control": bool
  "VoltageAC_control": bool
  "CurrentDC_control": bool
  "CurrentAC_control": bool
  "stop": bool
  "Auto Range_DCV": bool = TRUE
  "Auto Zero_DCV": bool = TRUE
  "Aperture NPLC_DCV": f64 = "10 PLC"(10)
  "Aperture Time_DCV": f64 = 0.1
  "Aperture_DCV": bool = TRUE
  "Manual Range_DCV": f64 = "1 V"(1)
  "Auto Range_DCVR": bool = TRUE
  "Manual Range_DCVR": f64 = "1 V"(1)
  "Aperture_DCVR": bool = TRUE
  "Aperture NPLC_DCVR": f64 = "10 PLC"(10)
  "Manual Range_ACV": f64 = "1 V"(1)
  "VoltageBandwidth_ACV": i32 = 1
  "Auto Range_ACV": bool = TRUE
  "Auto Range_DCC": bool = TRUE
  "Manual Range_DCC": f64 = "1 A"(1)
  "TerminalType_DCC": i32 = 1
  "Aperture_DCC": bool = TRUE
  "Aperture NPLC_DCC": f64 = "10 PLC"(10)
  "Auto Zero_DCC": bool = TRUE
  "TerminalType_ACC": i32 = 1
  "Auto Range_ACC": bool = TRUE
  "Manual Range_ACC": f64 = "1 A"(1)
  "VoltageBandwidth_ACC": i32 = 1
  "2WResistance_control": bool
  "4WResistance_control": bool
  "Frequency_control": bool
  "Capacitance_control": bool
  "Continuity_control": bool
  "Diode_control": bool
  "Temperature_control": bool
  "Auto Range_2WR": bool = TRUE
  "Manual Range_2WR": f64 = 1
  "Aperture_2WR": bool = TRUE
  "Aperture NPLC_2WR": f64 = "10 PLC"(10)
  "OffstComp_2WR": bool = TRUE
  "LowPower_2WR": bool = TRUE
  "Auto Zero_2WR": bool = TRUE
  "Auto Range_4WR": bool = TRUE
  "Manual Range_4WR": f64 = 1
  "Aperture_4WR": bool = TRUE
  "Aperture NPLC_4WR": f64 = "10 PLC"(10)
  "LowPower_4WR": bool = TRUE
  "OffstComp_4WR": bool = TRUE
  "Auto Range_Freq": bool = TRUE
  "Manual Range_Freq": f64 = "1 V"(1)
  "ACFilter_Freq": i32 = 1
  "GateTime_Freq": f64 = "1 s"(1)
  "Timeout_Freq": bool = TRUE
  "Auto Range_Capaci": bool = TRUE
  "Manual Range_Capaci": f64 = 1
  "Beeper_Cont": bool = TRUE
  "Beeper_Diode": bool = TRUE
  "Aperture_TempRTD4w": bool = TRUE
  "Aperture NPLC_TempRTD4w": f64 = "10 PLC"(10)
  "Units_TempRTD4w": i32 = "°C"(0)
  "Probe_TempMain": i32 = 10
  "OffstComp_TempRTD4w": bool = TRUE
  "LowPower_TempRTD4w": bool = TRUE
  "OffstComp_TempRTD2w": bool = TRUE
  "LowPower_TempRTD2w": bool = TRUE
  "Auto Zero_TempRTD2w": bool = TRUE
  "Aperture_TempRTD2w": bool = TRUE
  "Aperture NPLC_TempRTD2w": f64 = "10 PLC"(10)
  "Units_TempRTD2w": i32 = "°C"(0)
  "Units_TempThermis2w": i32 = "°C"(0)
  "Aperture_TempThermis2w": bool = TRUE
  "Aperture NPLC_TempThermis2w": f64 = "10 PLC"(10)
  "LowPower_TempThermis4w": bool = TRUE
  "LowPower_TempThermis2w": bool = TRUE
  "Aperture_TempThermis4w": bool = TRUE
  "Units_TempThermis4w": i32 = "°C"(0)
  "Aperture NPLC_TempThermis4w": f64 = "10 PLC"(10)
  "Auto Zero_TempThermis2w": bool = TRUE
panel indicators:
  "VoltageDC_indicator": bool
  "VoltageAC_indicator": bool
  "CurrentDC_indicator": bool
  "CurrentAC_indicator": bool
  "DCV Ratio_toenable": bool
  "Auto Impedance_DCV": bool
  "DIG Option On/Off_DCV": bool
  "String_DCV": string
  "String_DCVR": string
  "DIG Option On/Off_DCVR": bool
  "Aperture Time_DCVR": f64
  "DCV Ratio_todisable": bool
  "Auto Impedance_DCVR": bool
  "String_ACV": string
  "Aperture Time_DCC": f64
  "String_DCC": string
  "String_ACC": string
  "2WResistance_indicator": bool
  "4WResistance_indicator": bool
  "Frequency_indicator": bool
  "Capacitance_indicator": bool
  "Continuity_indicator": bool
  "Diode_indicator": bool
  "Temperature_indicator": bool
  "Aperture Time_2WR": f64
  "String_2WR": string
  "String_4WR": string
  "Aperture Time_4WR": f64
  "String_Freq": string
  "String_Capaci": string
  "String_Cont": string
  "String_Diode": string
  "String_TempRTD4w": string
  "Aperture Time_TempRTD4w": f64
  "R0_TempRTD4w": f64
  "R0_TempRTD2w": f64
  "Aperture Time_TempRTD2w": f64
  "Aperture Time_TempThermis2w": f64
  "Aperture Time_TempThermis4w": f64
  "String_TempThermis4w": string
  "String_TempThermis2w": string
  "String_TempRTD2w": string
diagram:
  # DCV DEFAULTS
  $"Auto Range_DCV" <- TRUE
  # DCVRATIO DEFAULTS
  # ACV DEFAULTS
  $"Auto Range_DCVR" <- TRUE
  $"Auto Zero_DCV" <- TRUE
  # TEMPMAIN DEFAULTS
  # TEMPRTD4W DEFAULTS
  # TEMPRTD2W DEFAULTS
  $Units_TempRTD4w <- "°C"(0)
  $Aperture_DCVR <- TRUE
  $"DIG Option On/Off_DCV" <- TRUE
  # CAPACI DEFAULTS
  # CONT DEFAULTS
  # DIODE DEFAULTS
  $Probe_TempMain <- "RTD 4w"(1)
  $"DIG Option On/Off_DCVR" <- TRUE
  $Aperture_DCV <- TRUE
  $"DCV Ratio_todisable" <- FALSE
  $"DCV Ratio_toenable" <- FALSE
  $"Auto Impedance_DCVR" <- FALSE
  $"Auto Impedance_DCV" <- FALSE
  # ACC DEFAULTS
  # 2WR DEFAULTS
  # DCC VISIBILITY
  # 4WR DEFAULTS
  # FREQ DEFAULTS
  Property Node(instance in=reference to "TerminalType_DCC", "Visible"=FALSE)
  # TEMPRTD2W VISIBILITY
  Property Node(instance in=reference to "Auto Zero_TempRTD2w", "Visible"=FALSE)
  # TEMPTHERMIS4W VISIBILITY
  Property Node(instance in=reference to "Aperture NPLC_TempThermis4w", "Visible"=FALSE)
  # TEMPRTD4W VISIBILITY
  Property Node(instance in=reference to "LowPower_TempRTD4w", "Visible"=FALSE)
  # DCV VISIBILITY
  Property Node(instance in=reference to "DIG Option On/Off_DCV", "Visible"=FALSE)
  # DCVRATIO VISIBILITY
  Property Node(instance in=reference to "DIG Option On/Off_DCVR", "Visible"=FALSE)
  # DCC DEFAULTS
  # ACV VISIBILITY
  Property Node(instance in=reference to "Manual Range_ACV", "Visible"=FALSE)
  # 4WR VISIBILITY
  Property Node(instance in=reference to "Aperture NPLC_4WR", "Visible"=FALSE)
  # TEMPTHERMIS2W VISIBILITY
  Property Node(instance in=reference to "Aperture NPLC_TempThermis2w", "Visible"=FALSE)
  # ACC VISIBILITY
  Property Node(instance in=reference to "TerminalType_ACC", "Visible"=FALSE)
  # CONT VISIBILITY
  Property Node(instance in=reference to "Beeper_Cont", "Visible"=FALSE)
  # 2WR VISIBILITY
  Property Node(instance in=reference to "Aperture NPLC_2WR", "Visible"=FALSE)
  # FREQ VISIBILITY
  Property Node(instance in=reference to "ACFilter_Freq", "Visible"=FALSE)
  # CAPACI VISIBILITY
  Property Node(instance in=reference to "Manual Range_Capaci", "Visible"=FALSE)
  # DIODE VISIBILITY
  Property Node(instance in=reference to "Beeper_Diode", "Visible"=FALSE)
  # TEMPMAIN VISIBILITY
  Property Node(instance in=reference to "Probe_TempMain", "Visible"=FALSE)
  Property Node(instance in=reference to "Auto Range_DCC", "Visible"=FALSE)
  Property Node(instance in=reference to "LowPower_TempRTD2w", "Visible"=FALSE)
  Property Node(instance in=reference to "Aperture Time_TempThermis4w", "Visible"=FALSE)
  Property Node(instance in=reference to "OffstComp_TempRTD4w", "Visible"=FALSE)
  Property Node(instance in=reference to "Aperture Time_TempThermis2w", "Visible"=FALSE)
  Property Node(instance in=reference to "Auto Impedance_DCV", "Visible"=FALSE)
  Property Node(instance in=reference to "Auto Impedance_DCVR", "Visible"=FALSE)
  Property Node(instance in=reference to "Aperture Time_4WR", "Visible"=FALSE)
  Property Node(instance in=reference to "VoltageBandwidth_ACC", "Visible"=FALSE)
  Property Node(instance in=reference to "String_Cont", "Visible"=FALSE)
  Property Node(instance in=reference to "VoltageBandwidth_ACV", "Visible"=FALSE)
  Property Node(instance in=reference to "Aperture Time_2WR", "Visible"=FALSE)
  Property Node(instance in=reference to "Auto Range_Freq", "Visible"=FALSE)
  Property Node(instance in=reference to "Auto Range_Capaci", "Visible"=FALSE)
  Property Node(instance in=reference to "String_Diode", "Visible"=FALSE)
  Property Node(instance in=reference to "Manual Range_DCC", "Visible"=FALSE)
  Property Node(instance in=reference to "OffstComp_TempRTD2w", "Visible"=FALSE)
  Property Node(instance in=reference to "Aperture_TempThermis4w", "Visible"=FALSE)
  Property Node(instance in=reference to "Aperture_TempThermis2w", "Visible"=FALSE)
  Property Node(instance in=reference to "R0_TempRTD4w", "Visible"=FALSE)
  Property Node(instance in=reference to "Manual Range_DCV", "Visible"=FALSE, "Disabled"=TRUE)
  Property Node(instance in=reference to "Manual Range_DCVR", "Visible"=FALSE)
  Property Node(instance in=reference to "Aperture_4WR", "Visible"=FALSE)
  Property Node(instance in=reference to "Manual Range_ACC", "Visible"=FALSE)
  Property Node(instance in=reference to "Aperture_2WR", "Visible"=FALSE)
  Property Node(instance in=reference to "GateTime_Freq", "Visible"=FALSE)
  Property Node(instance in=reference to "String_Capaci", "Visible"=FALSE)
  Property Node(instance in=reference to "String_ACV", "Visible"=FALSE)
  Property Node(instance in=reference to "Aperture_DCC", "Visible"=FALSE)
  Property Node(instance in=reference to "R0_TempRTD2w", "Visible"=FALSE)
  Property Node(instance in=reference to "LowPower_TempThermis4w", "Visible"=FALSE)
  Property Node(instance in=reference to "Auto Zero_TempThermis2w", "Visible"=FALSE)
  Property Node(instance in=reference to "Aperture NPLC_TempRTD4w", "Visible"=FALSE)
  Property Node(instance in=reference to "Aperture NPLC_DCV", "Visible"=FALSE)
  Property Node(instance in=reference to "Aperture NPLC_DCVR", "Visible"=FALSE)
  Property Node(instance in=reference to "Auto Range_4WR", "Visible"=FALSE)
  Property Node(instance in=reference to "Auto Range_ACC", "Visible"=FALSE)
  Property Node(instance in=reference to "Auto Range_2WR", "Visible"=FALSE)
  Property Node(instance in=reference to "Manual Range_Freq", "Visible"=FALSE)
  Property Node(instance in=reference to "Auto Range_ACV", "Visible"=FALSE)
  Property Node(instance in=reference to "Aperture NPLC_DCC", "Visible"=FALSE)
  Property Node(instance in=reference to "Aperture NPLC_TempRTD2w", "Visible"=FALSE)
  Property Node(instance in=reference to "Units_TempThermis4w", "Visible"=FALSE)
  Property Node(instance in=reference to "LowPower_TempThermis2w", "Visible"=FALSE)
  Property Node(instance in=reference to "Aperture Time_TempRTD4w", "Visible"=FALSE)
  Property Node(instance in=reference to "Aperture_DCV", "Visible"=FALSE)
  Property Node(instance in=reference to "Aperture_DCVR", "Visible"=FALSE)
  Property Node(instance in=reference to "LowPower_4WR", "Visible"=FALSE)
  Property Node(instance in=reference to "String_ACC", "Visible"=FALSE)
  Property Node(instance in=reference to "Auto Zero_2WR", "Visible"=FALSE)
  Property Node(instance in=reference to "Timeout_Freq", "Visible"=FALSE)
  Property Node(instance in=reference to "Aperture Time_DCC", "Visible"=FALSE)
  Property Node(instance in=reference to "Aperture Time_TempRTD2w", "Visible"=FALSE)
  Property Node(instance in=reference to "String_TempThermis4w", "Visible"=FALSE)
  Property Node(instance in=reference to "Units_TempThermis2w", "Visible"=FALSE)
  Property Node(instance in=reference to "Aperture_TempRTD4w", "Visible"=FALSE)
  Property Node(instance in=reference to "Auto Range_DCV", "Visible"=FALSE)
  Property Node(instance in=reference to "Auto Range_DCVR", "Visible"=FALSE)
  Property Node(instance in=reference to "Manual Range_4WR", "Visible"=FALSE)
  Property Node(instance in=reference to "LowPower_2WR", "Visible"=FALSE)
  Property Node(instance in=reference to "String_Freq", "Visible"=FALSE)
  Property Node(instance in=reference to "Auto Zero_DCC", "Visible"=FALSE)
  Property Node(instance in=reference to "Aperture_TempRTD2w", "Visible"=FALSE)
  Property Node(instance in=reference to "String_TempThermis2w", "Visible"=FALSE)
  Property Node(instance in=reference to "Units_TempRTD4w", "Visible"=FALSE)
  Property Node(instance in=reference to "DCV Ratio_toenable", "Visible"=FALSE)
  Property Node(instance in=reference to "DCV Ratio_todisable", "Visible"=FALSE)
  Property Node(instance in=reference to "OffstComp_4WR", "Visible"=FALSE)
  Property Node(instance in=reference to "Manual Range_2WR", "Visible"=FALSE)
  Property Node(instance in=reference to "Units_TempRTD2w", "Visible"=FALSE)
  Property Node(instance in=reference to "String_TempRTD4w", "Visible"=FALSE)
  Property Node(instance in=reference to "Aperture Time_DCV", "Visible"=FALSE)
  Property Node(instance in=reference to "Aperture Time_DCVR", "Visible"=FALSE)
  Property Node(instance in=reference to "String_4WR", "Visible"=FALSE)
  Property Node(instance in=reference to "String_DCC", "Visible"=FALSE)
  Property Node(instance in=reference to "OffstComp_2WR", "Visible"=FALSE)
  Property Node(instance in=reference to "String_TempRTD2w", "Visible"=FALSE)
  Property Node(instance in=reference to "String_DCV", "Visible"=FALSE)
  Property Node(instance in=reference to "String_DCVR", "Visible"=FALSE)
  Property Node(instance in=reference to "String_2WR", "Visible"=FALSE)
  Property Node(instance in=reference to "Auto Zero_DCV", "Visible"=FALSE)
  # MAIN DEFAULTS
  $stop <- FALSE
  $VoltageAC_control <- FALSE
  $VoltageDC_control <- FALSE
  $CurrentDC_control <- FALSE
  # TITLES VISIBILITY
  Property Node(instance in=reference to unnamed text, "Visible"=TRUE)
  $CurrentAC_control <- FALSE
  $"2WResistance_control" <- FALSE
  # BUTTONS VISIBILITY
  Property Node(instance in=reference to "VoltageAC_control", "Visible"=TRUE, "Disabled"=FALSE)
  Property Node(instance in=reference to "CurrentDC_control", "Visible"=TRUE, "Disabled"=FALSE)
  Property Node(instance in=reference to "CurrentAC_control", "Visible"=TRUE, "Disabled"=FALSE)
  Property Node(instance in=reference to "2WResistance_control", "Visible"=TRUE, "Disabled"=FALSE)
  Property Node(instance in=reference to "VoltageDC_indicator", "Visible"=FALSE)
  Property Node(instance in=reference to "4WResistance_control", "Visible"=TRUE, "Disabled"=FALSE)
  Property Node(instance in=reference to "Frequency_control", "Visible"=TRUE, "Disabled"=FALSE)
  Property Node(instance in=reference to "Capacitance_control", "Visible"=TRUE, "Disabled"=FALSE)
  Property Node(instance in=reference to "Continuity_control", "Visible"=TRUE, "Disabled"=FALSE)
  Property Node(instance in=reference to "Diode_control", "Visible"=TRUE, "Disabled"=FALSE)
  Property Node(instance in=reference to "Temperature_control", "Visible"=TRUE, "Disabled"=FALSE)
  Property Node(instance in=reference to unnamed text, "Visible"=FALSE)
  $"4WResistance_control" <- FALSE
  $Frequency_control <- FALSE
  Property Node(instance in=reference to "VoltageDC_control", "Visible"=TRUE, "Disabled"=FALSE)
  $Capacitance_control <- FALSE
  Property Node(instance in=reference to "VoltageAC_indicator", "Visible"=FALSE)
  Property Node(instance in=reference to "CurrentDC_indicator", "Visible"=FALSE)
  Property Node(instance in=reference to "CurrentAC_indicator", "Visible"=FALSE, "Disabled"=FALSE)
  Property Node(instance in=reference to "2WResistance_indicator", "Visible"=FALSE, "Disabled"=FALSE)
  Property Node(instance in=reference to unnamed text, "Visible"=FALSE)
  Property Node(instance in=reference to "4WResistance_indicator", "Visible"=FALSE, "Disabled"=FALSE)
  Property Node(instance in=reference to "Frequency_indicator", "Visible"=FALSE, "Disabled"=FALSE)
  Property Node(instance in=reference to "Capacitance_indicator", "Visible"=FALSE, "Disabled"=FALSE)
  Property Node(instance in=reference to "Continuity_indicator", "Visible"=FALSE, "Disabled"=FALSE)
  Property Node(instance in=reference to "Diode_indicator", "Visible"=FALSE, "Disabled"=FALSE)
  Property Node(instance in=reference to "Temperature_indicator", "Visible"=FALSE, "Disabled"=FALSE)
  $Continuity_control <- FALSE
  $Diode_control <- FALSE
  Property Node(instance in=reference to unnamed text, "Visible"=FALSE)
  $Temperature_control <- FALSE
  while {
    # ACV CONTROLS/INDICATORS
    # 2WR CONTROLS/INDICATORS
    # 4WR CONTROLS/INDICATORS
    # FREQ CONTROLS/INDICATORS
    event {
      on "VoltageDC_control" Value changed {
        # TITLES VISIBILITY
        Property Node(instance in=reference to unnamed text, "Visible"=FALSE)
        # DCV VISIBILITY
        Property Node(instance in=reference to "DIG Option On/Off_DCV", "Visible"=TRUE)
        # DCC VISIBILITY
        Property Node(instance in=reference to "TerminalType_DCC", "Visible"=FALSE)
        # ACV VISIBILITY
        Property Node(instance in=reference to "Manual Range_ACV", "Visible"=FALSE)
        Property Node(instance in=reference to unnamed text, "Visible"=TRUE)
        # DCVRATIO VISIBILITY
        Property Node(instance in=reference to "DIG Option On/Off_DCVR", "Visible"=FALSE)
        # 2WR VISIBILITY
        Property Node(instance in=reference to "Aperture NPLC_2WR", "Visible"=FALSE)
        # 4WR VISIBILITY
        Property Node(instance in=reference to "Aperture NPLC_4WR", "Visible"=FALSE)
        Property Node(instance in=reference to "Auto Impedance_DCV", "Visible"=TRUE)
        # ACC VISIBILITY
        Property Node(instance in=reference to "TerminalType_ACC", "Visible"=FALSE)
        # FREQ VISIBILITY
        Property Node(instance in=reference to "ACFilter_Freq", "Visible"=FALSE)
        Property Node(instance in=reference to "Auto Range_DCC", "Visible"=FALSE)
        Property Node(instance in=reference to unnamed text, "Visible"=FALSE)
        Property Node(instance in=reference to "Auto Impedance_DCVR", "Visible"=FALSE)
        Property Node(instance in=reference to "VoltageBandwidth_ACV", "Visible"=FALSE)
        Property Node(instance in=reference to "Aperture Time_2WR", "Visible"=FALSE)
        Property Node(instance in=reference to "Aperture Time_4WR", "Visible"=FALSE)
        # CAPACI VISIBILITY
        Property Node(instance in=reference to "Manual Range_Capaci", "Visible"=FALSE)
        Property Node(instance in=reference to "Manual Range_DCV", "Visible"=TRUE, "Disabled"=TRUE)
        Property Node(instance in=reference to "VoltageBandwidth_ACC", "Visible"=FALSE)
        Property Node(instance in=reference to "Auto Range_Freq", "Visible"=FALSE)
        Property Node(instance in=reference to "Manual Range_DCC", "Visible"=FALSE)
        Property Node(instance in=reference to unnamed text, "Visible"=FALSE)
        Property Node(instance in=reference to "Manual Range_DCVR", "Visible"=FALSE)
        Property Node(instance in=reference to "String_ACV", "Visible"=FALSE)
        Property Node(instance in=reference to "Aperture_2WR", "Visible"=FALSE)
        Property Node(instance in=reference to "Aperture_4WR", "Visible"=FALSE)
        Property Node(instance in=reference to "Auto Range_Capaci", "Visible"=FALSE)
        Property Node(instance in=reference to "Aperture NPLC_DCV", "Visible"=TRUE)
        Property Node(instance in=reference to "Manual Range_ACC", "Visible"=FALSE)
        Property Node(instance in=reference to "GateTime_Freq", "Visible"=FALSE)
        Property Node(instance in=reference to "Aperture_DCC", "Visible"=FALSE)
        Property Node(instance in=reference to "Aperture NPLC_DCVR", "Visible"=FALSE)
        Property Node(instance in=reference to unnamed text, "Visible"=FALSE)
        Property Node(instance in=reference to "Auto Range_2WR", "Visible"=FALSE)
        Property Node(instance in=reference to "Auto Range_4WR", "Visible"=FALSE)
        Property Node(instance in=reference to "String_Capaci", "Visible"=FALSE)
        Property Node(instance in=reference to "Auto Range_ACV", "Visible"=FALSE)
        Property Node(instance in=reference to "Aperture_DCV", "Visible"=TRUE)
        Property Node(instance in=reference to "Auto Range_ACC", "Visible"=FALSE)
        Property Node(instance in=reference to "Manual Range_Freq", "Visible"=FALSE)
        Property Node(instance in=reference to "Aperture NPLC_DCC", "Visible"=FALSE)
        Property Node(instance in=reference to "Aperture_DCVR", "Visible"=FALSE)
        Property Node(instance in=reference to unnamed text, "Visible"=FALSE)
        Property Node(instance in=reference to "Auto Zero_2WR", "Visible"=FALSE)
        Property Node(instance in=reference to "LowPower_4WR", "Visible"=FALSE)
        Property Node(instance in=reference to "Auto Range_DCV", "Visible"=TRUE)
        Property Node(instance in=reference to "String_ACC", "Visible"=FALSE)
        Property Node(instance in=reference to "Timeout_Freq", "Visible"=FALSE)
        Property Node(instance in=reference to "Aperture Time_DCC", "Visible"=FALSE)
        Property Node(instance in=reference to "Auto Range_DCVR", "Visible"=FALSE)
        Property Node(instance in=reference to unnamed text, "Visible"=FALSE)
        Property Node(instance in=reference to "LowPower_2WR", "Visible"=FALSE)
        Property Node(instance in=reference to "Manual Range_4WR", "Visible"=FALSE)
        Property Node(instance in=reference to "DCV Ratio_toenable", "Visible"=TRUE)
        Property Node(instance in=reference to "String_Freq", "Visible"=FALSE)
        Property Node(instance in=reference to "Auto Zero_DCC", "Visible"=FALSE)
        Property Node(instance in=reference to "DCV Ratio_todisable", "Visible"=FALSE)
        Property Node(instance in=reference to unnamed text, "Visible"=FALSE)
        Property Node(instance in=reference to "Manual Range_2WR", "Visible"=FALSE)
        Property Node(instance in=reference to "OffstComp_4WR", "Visible"=FALSE)
        Property Node(instance in=reference to "Aperture Time_DCV", "Visible"=TRUE)
        Property Node(instance in=reference to "Aperture Time_DCVR", "Visible"=FALSE)
        Property Node(instance in=reference to unnamed text, "Visible"=FALSE)
        Property Node(instance in=reference to "String_DCC", "Visible"=FALSE)
        Property Node(instance in=reference to "OffstComp_2WR", "Visible"=FALSE)
        Property Node(instance in=reference to "String_4WR", "Visible"=FALSE)
        Property Node(instance in=reference to "String_DCV", "Visible"=TRUE)
        Property Node(instance in=reference to "String_DCVR", "Visible"=FALSE)
        Property Node(instance in=reference to unnamed text, "Visible"=FALSE)
        Property Node(instance in=reference to "String_2WR", "Visible"=FALSE)
        Property Node(instance in=reference to "Auto Zero_DCV", "Visible"=TRUE)
        Property Node(instance in=reference to unnamed text, "Visible"=FALSE)
        Property Node(instance in=reference to unnamed text, "Visible"=FALSE)
        # CONT VISIBILITY
        Property Node(instance in=reference to "Beeper_Cont", "Visible"=FALSE)
        # DIODE VISIBILITY
        Property Node(instance in=reference to "Beeper_Diode", "Visible"=FALSE)
        # TEMPRTD2W VISIBILITY
        Property Node(instance in=reference to "Auto Zero_TempRTD2w", "Visible"=FALSE)
        # TEMPRTD4W VISIBILITY
        Property Node(instance in=reference to "LowPower_TempRTD4w", "Visible"=FALSE)
        # TEMPTHERMIS4W VISIBILITY
        Property Node(instance in=reference to "Aperture NPLC_TempThermis4w", "Visible"=FALSE)
        Property Node(instance in=reference to unnamed text, "Visible"=FALSE)
        # TEMPTHERMIS2W VISIBILITY
        Property Node(instance in=reference to "Aperture NPLC_TempThermis2w", "Visible"=FALSE)
        # TEMPMAIN VISIBILITY
        Property Node(instance in=reference to "Probe_TempMain", "Visible"=FALSE)
        Property Node(instance in=reference to "String_Cont", "Visible"=FALSE)
        Property Node(instance in=reference to "String_Diode", "Visible"=FALSE)
        Property Node(instance in=reference to "LowPower_TempRTD2w", "Visible"=FALSE)
        Property Node(instance in=reference to "OffstComp_TempRTD4w", "Visible"=FALSE)
        Property Node(instance in=reference to "Aperture Time_TempThermis4w", "Visible"=FALSE)
        Property Node(instance in=reference to "Aperture Time_TempThermis2w", "Visible"=FALSE)
        Property Node(instance in=reference to "OffstComp_TempRTD2w", "Visible"=FALSE)
        Property Node(instance in=reference to "R0_TempRTD4w", "Visible"=FALSE)
        Property Node(instance in=reference to "Aperture_TempThermis4w", "Visible"=FALSE)
        Property Node(instance in=reference to "Aperture_TempThermis2w", "Visible"=FALSE)
        Property Node(instance in=reference to "R0_TempRTD2w", "Visible"=FALSE)
        Property Node(instance in=reference to "Aperture NPLC_TempRTD4w", "Visible"=FALSE)
        Property Node(instance in=reference to "LowPower_TempThermis4w", "Visible"=FALSE)
        Property Node(instance in=reference to "Auto Zero_TempThermis2w", "Visible"=FALSE)
        Event Data() -> ("Old Value"=w2, "New Value"=w3)
        # EVENT NIE DLA
        # CONTROL NEW VALUE F
        # INDICATOR OLD
        Property Node(instance in=reference to "VoltageAC_indicator", "Visible"=w2)
        Property Node(instance in=reference to "Aperture NPLC_TempRTD2w", "Visible"=FALSE)
        Property Node(instance in=reference to "Aperture Time_TempRTD4w", "Visible"=FALSE)
        Property Node(instance in=reference to "Units_TempThermis4w", "Visible"=FALSE)
        Property Node(instance in=reference to "LowPower_TempThermis2w", "Visible"=FALSE)
        Property Node(instance in=reference to "Aperture Time_TempRTD2w", "Visible"=FALSE)
        Property Node(instance in=reference to "Aperture_TempRTD4w", "Visible"=FALSE)
        Property Node(instance in=reference to "CurrentDC_indicator", "Visible"=w2)
        Property Node(instance in=reference to "String_TempThermis4w", "Visible"=FALSE)
        Property Node(instance in=reference to "Units_TempThermis2w", "Visible"=FALSE)
        Property Node(instance in=reference to "Aperture_TempRTD2w", "Visible"=FALSE)
        Property Node(instance in=reference to "Units_TempRTD4w", "Visible"=FALSE)
        Property Node(instance in=reference to "String_TempThermis2w", "Visible"=FALSE)
        Property Node(instance in=reference to "CurrentAC_indicator", "Visible"=w2)
        Property Node(instance in=reference to "Units_TempRTD2w", "Visible"=FALSE)
        Property Node(instance in=reference to "String_TempRTD4w", "Visible"=FALSE)
        Property Node(instance in=reference to "2WResistance_indicator", "Visible"=w2)
        Property Node(instance in=reference to "String_TempRTD2w", "Visible"=FALSE)
        Property Node(instance in=reference to "4WResistance_indicator", "Visible"=w2)
        Property Node(instance in=reference to "Frequency_indicator", "Visible"=w2)
        Property Node(instance in=reference to "Capacitance_indicator", "Visible"=w2)
        Property Node(instance in=reference to "Continuity_indicator", "Visible"=w2)
        Property Node(instance in=reference to "Diode_indicator", "Visible"=w2)
        Property Node(instance in=reference to "Temperature_indicator", "Visible"=w2)
        # EVENT DLA
        # CONTROL OLD
        # INDICATOR NEW
        Property Node(instance in=reference to "VoltageDC_control", "Visible"=w2)
        Property Node(instance in=reference to "VoltageDC_indicator", "Visible"=w3)
        Property Node(instance in=reference to "VoltageAC_control", "Visible"=w3, "Value"=FALSE)
        Property Node(instance in=reference to "CurrentDC_control", "Visible"=w3, "Value"=FALSE)
        Property Node(instance in=reference to "CurrentAC_control", "Visible"=w3, "Value"=FALSE)
        Property Node(instance in=reference to "2WResistance_control", "Visible"=w3, "Value"=FALSE)
        Property Node(instance in=reference to "4WResistance_control", "Visible"=w3, "Value"=FALSE)
        Property Node(instance in=reference to "Frequency_control", "Visible"=w3, "Value"=FALSE)
        Property Node(instance in=reference to "Capacitance_control", "Visible"=w3, "Value"=FALSE)
        Property Node(instance in=reference to "Continuity_control", "Visible"=w3, "Value"=FALSE)
        Property Node(instance in=reference to "Diode_control", "Visible"=w3, "Value"=FALSE)
        Property Node(instance in=reference to "Temperature_control", "Visible"=w3, "Value"=FALSE)
        w1 = default
      }
      on "DCV Ratio_toenable" Value changed {
        Property Node(instance in=reference to "Auto Range_DCV", "Visible"=FALSE)
        Property Node(instance in=reference to "String_DCV", "Visible"=FALSE)
        Property Node(instance in=reference to "DIG Option On/Off_DCVR", "Visible"=TRUE)
        Property Node(instance in=reference to "Auto Zero_DCV", "Visible"=FALSE)
        Property Node(instance in=reference to "Auto Impedance_DCVR", "Visible"=TRUE)
        Property Node(instance in=reference to "Manual Range_DCVR", "Visible"=TRUE)
        Property Node(instance in=reference to "Aperture NPLC_DCVR", "Visible"=TRUE)
        Property Node(instance in=reference to "Aperture_DCV", "Visible"=FALSE)
        Property Node(instance in=reference to "Aperture_DCVR", "Visible"=TRUE)
        Property Node(instance in=reference to unnamed text, "Visible"=FALSE)
        Property Node(instance in=reference to "Auto Range_DCVR", "Visible"=TRUE)
        Property Node(instance in=reference to "DCV Ratio_toenable", "Visible"=FALSE)
        Property Node(instance in=reference to "DCV Ratio_todisable", "Visible"=TRUE)
        Property Node(instance in=reference to unnamed text, "Visible"=TRUE)
        Property Node(instance in=reference to "Aperture Time_DCVR", "Visible"=TRUE)
        Property Node(instance in=reference to "Manual Range_DCV", "Visible"=FALSE)
        Property Node(instance in=reference to "String_DCVR", "Visible"=TRUE)
        Property Node(instance in=reference to unnamed text, "Visible"=FALSE)
        Event Data() -> ("New Value"=w4)
        Property Node(instance in=reference to "DCV Ratio_todisable", "Visible"=w4, "Value"=w4)
        Property Node(instance in=reference to "Aperture NPLC_DCV", "Visible"=FALSE)
        Property Node(instance in=reference to "VoltageAC_indicator", "Visible"=FALSE)
        Property Node(instance in=reference to "DCV Ratio_toenable", "Visible"=FALSE)
        Property Node(instance in=reference to unnamed text, "Visible"=FALSE)
        Property Node(instance in=reference to "DIG Option On/Off_DCV", "Visible"=FALSE)
        Property Node(instance in=reference to "Aperture Time_DCV", "Visible"=FALSE)
        Property Node(instance in=reference to "Auto Impedance_DCV", "Visible"=FALSE)
        w1 = default
      }
      on "DCV Ratio_todisable" Value changed {
        Property Node(instance in=reference to "Auto Range_DCV", "Visible"=TRUE)
        Property Node(instance in=reference to "String_DCV", "Visible"=TRUE)
        Property Node(instance in=reference to "DIG Option On/Off_DCVR", "Visible"=FALSE)
        Property Node(instance in=reference to "DIG Option On/Off_DCV", "Visible"=TRUE)
        Property Node(instance in=reference to "Auto Zero_DCV", "Visible"=TRUE)
        Property Node(instance in=reference to "Auto Impedance_DCVR", "Visible"=FALSE)
        Property Node(instance in=reference to "Aperture Time_DCV", "Visible"=TRUE)
        Property Node(instance in=reference to "Manual Range_DCVR", "Visible"=FALSE)
        Property Node(instance in=reference to "Aperture NPLC_DCVR", "Visible"=FALSE)
        Property Node(instance in=reference to "Aperture_DCV", "Visible"=TRUE)
        Property Node(instance in=reference to "Aperture_DCVR", "Visible"=FALSE)
        Property Node(instance in=reference to unnamed text, "Visible"=FALSE)
        Property Node(instance in=reference to "Auto Range_DCVR", "Visible"=FALSE)
        Property Node(instance in=reference to "DCV Ratio_todisable", "Visible"=FALSE)
        Property Node(instance in=reference to unnamed text, "Visible"=FALSE)
        Property Node(instance in=reference to "Aperture Time_DCVR", "Visible"=FALSE)
        Property Node(instance in=reference to "Manual Range_DCV", "Visible"=TRUE)
        Property Node(instance in=reference to "String_DCVR", "Visible"=FALSE)
        Property Node(instance in=reference to unnamed text, "Visible"=TRUE)
        Property Node(instance in=reference to "Aperture NPLC_DCV", "Visible"=TRUE)
        Event Data() -> ("New Value"=w5)
        Property Node(instance in=reference to "DCV Ratio_toenable", "Visible"=TRUE, "Value"=w5)
        Property Node(instance in=reference to "Auto Impedance_DCV", "Visible"=TRUE)
        w1 = default
      }
      on "VoltageAC_control" Value changed {
        # TITLES VISIBILITY
        Property Node(instance in=reference to unnamed text, "Visible"=FALSE)
        # 4WR VISIBILITY
        Property Node(instance in=reference to "Aperture NPLC_4WR", "Visible"=FALSE)
        # 2WR VISIBILITY
        Property Node(instance in=reference to "Aperture NPLC_2WR", "Visible"=FALSE)
        # DCV VISIBILITY
        Property Node(instance in=reference to "DIG Option On/Off_DCV", "Visible"=FALSE)
        # FREQ VISIBILITY
        Property Node(instance in=reference to "ACFilter_Freq", "Visible"=FALSE)
        # DCC VISIBILITY
        Property Node(instance in=reference to "TerminalType_DCC", "Visible"=FALSE)
        # CAPACI VISIBILITY
        Property Node(instance in=reference to "Manual Range_Capaci", "Visible"=FALSE)
        # ACV VISIBILITY
        Property Node(instance in=reference to "Manual Range_ACV", "Visible"=TRUE)
        Property Node(instance in=reference to unnamed text, "Visible"=FALSE)
        # DCVRATIO VISIBILITY
        Property Node(instance in=reference to "DIG Option On/Off_DCVR", "Visible"=FALSE)
        Property Node(instance in=reference to "Aperture Time_4WR", "Visible"=FALSE)
        Property Node(instance in=reference to "Aperture Time_2WR", "Visible"=FALSE)
        Property Node(instance in=reference to "Auto Impedance_DCV", "Visible"=FALSE)
        # ACC VISIBILITY
        Property Node(instance in=reference to "TerminalType_ACC", "Visible"=FALSE)
        Property Node(instance in=reference to "Auto Range_Freq", "Visible"=FALSE)
        Property Node(instance in=reference to "Auto Range_DCC", "Visible"=FALSE)
        Property Node(instance in=reference to "Auto Range_Capaci", "Visible"=FALSE)
        Property Node(instance in=reference to unnamed text, "Visible"=TRUE)
        Property Node(instance in=reference to "Auto Impedance_DCVR", "Visible"=FALSE)
        Property Node(instance in=reference to "VoltageBandwidth_ACV", "Visible"=TRUE)
        # CONT VISIBILITY
        Property Node(instance in=reference to "Beeper_Cont", "Visible"=FALSE)
        Property Node(instance in=reference to "Aperture_4WR", "Visible"=FALSE)
        # DIODE VISIBILITY
        Property Node(instance in=reference to "Beeper_Diode", "Visible"=FALSE)
        Property Node(instance in=reference to "Aperture_2WR", "Visible"=FALSE)
        Property Node(instance in=reference to "Manual Range_DCV", "Visible"=FALSE, "Disabled"=TRUE)
        Property Node(instance in=reference to "VoltageBandwidth_ACC", "Visible"=FALSE)
        Property Node(instance in=reference to "GateTime_Freq", "Visible"=FALSE)
        Property Node(instance in=reference to "Manual Range_DCC", "Visible"=FALSE)
        Property Node(instance in=reference to "String_Capaci", "Visible"=FALSE)
        Property Node(instance in=reference to unnamed text, "Visible"=FALSE)
        Property Node(instance in=reference to "Manual Range_DCVR", "Visible"=FALSE)
        Property Node(instance in=reference to "String_ACV", "Visible"=TRUE)
        Property Node(instance in=reference to "String_Cont", "Visible"=FALSE)
        Property Node(instance in=reference to "Auto Range_4WR", "Visible"=FALSE)
        Property Node(instance in=reference to "String_Diode", "Visible"=FALSE)
        Property Node(instance in=reference to "Auto Range_2WR", "Visible"=FALSE)
        Property Node(instance in=reference to "Aperture NPLC_DCV", "Visible"=FALSE)
        Property Node(instance in=reference to "Manual Range_ACC", "Visible"=FALSE)
        Property Node(instance in=reference to "Manual Range_Freq", "Visible"=FALSE)
        Property Node(instance in=reference to "Aperture_DCC", "Visible"=FALSE)
        Property Node(instance in=reference to "Aperture NPLC_DCVR", "Visible"=FALSE)
        Property Node(instance in=reference to unnamed text, "Visible"=FALSE)
        Property Node(instance in=reference to "LowPower_4WR", "Visible"=FALSE)
        Property Node(instance in=reference to "Auto Range_ACV", "Visible"=TRUE)
        Property Node(instance in=reference to "Auto Zero_2WR", "Visible"=FALSE)
        Property Node(instance in=reference to "Aperture_DCV", "Visible"=FALSE)
        Property Node(instance in=reference to "Auto Range_ACC", "Visible"=FALSE)
        Property Node(instance in=reference to "Timeout_Freq", "Visible"=FALSE)
        Property Node(instance in=reference to "Aperture NPLC_DCC", "Visible"=FALSE)
        Property Node(instance in=reference to "Aperture_DCVR", "Visible"=FALSE)
        Property Node(instance in=reference to unnamed text, "Visible"=FALSE)
        Property Node(instance in=reference to "Manual Range_4WR", "Visible"=FALSE)
        Property Node(instance in=reference to "LowPower_2WR", "Visible"=FALSE)
        Property Node(instance in=reference to "Auto Range_DCV", "Visible"=FALSE)
        Property Node(instance in=reference to "String_ACC", "Visible"=FALSE)
        Property Node(instance in=reference to "String_Freq", "Visible"=FALSE)
        Property Node(instance in=reference to "Aperture Time_DCC", "Visible"=FALSE)
        Property Node(instance in=reference to "Auto Range_DCVR", "Visible"=FALSE)
        Property Node(instance in=reference to unnamed text, "Visible"=FALSE)
        Property Node(instance in=reference to "OffstComp_4WR", "Visible"=FALSE)
        Property Node(instance in=reference to "Manual Range_2WR", "Visible"=FALSE)
        Property Node(instance in=reference to "DCV Ratio_toenable", "Visible"=FALSE)
        Property Node(instance in=reference to "Auto Zero_DCC", "Visible"=FALSE)
        Property Node(instance in=reference to "DCV Ratio_todisable", "Visible"=FALSE)
        Property Node(instance in=reference to unnamed text, "Visible"=FALSE)
        Property Node(instance in=reference to "String_4WR", "Visible"=FALSE)
        Property Node(instance in=reference to "OffstComp_2WR", "Visible"=FALSE)
        Property Node(instance in=reference to "Aperture Time_DCV", "Visible"=FALSE)
        Property Node(instance in=reference to "Aperture Time_DCVR", "Visible"=FALSE)
        Property Node(instance in=reference to unnamed text, "Visible"=FALSE)
        Property Node(instance in=reference to "String_DCC", "Visible"=FALSE)
        Property Node(instance in=reference to "String_2WR", "Visible"=FALSE)
        Property Node(instance in=reference to "String_DCV", "Visible"=FALSE)
        Property Node(instance in=reference to "String_DCVR", "Visible"=FALSE)
        Property Node(instance in=reference to unnamed text, "Visible"=FALSE)
        Property Node(instance in=reference to "Auto Zero_DCV", "Visible"=FALSE)
        # TEMPRTD2W VISIBILITY
        Property Node(instance in=reference to "Auto Zero_TempRTD2w", "Visible"=FALSE)
        # TEMPRTD4W VISIBILITY
        Property Node(instance in=reference to "LowPower_TempRTD4w", "Visible"=FALSE)
        Property Node(instance in=reference to unnamed text, "Visible"=FALSE)
        # TEMPMAIN VISIBILITY
        Property Node(instance in=reference to "Probe_TempMain", "Visible"=FALSE)
        Property Node(instance in=reference to "LowPower_TempRTD2w", "Visible"=FALSE)
        Property Node(instance in=reference to "OffstComp_TempRTD4w", "Visible"=FALSE)
        Property Node(instance in=reference to unnamed text, "Visible"=FALSE)
        Property Node(instance in=reference to "OffstComp_TempRTD2w", "Visible"=FALSE)
        Property Node(instance in=reference to "R0_TempRTD4w", "Visible"=FALSE)
        Property Node(instance in=reference to unnamed text, "Visible"=FALSE)
        Property Node(instance in=reference to "R0_TempRTD2w", "Visible"=FALSE)
        Property Node(instance in=reference to "Aperture NPLC_TempRTD4w", "Visible"=FALSE)
        Property Node(instance in=reference to "Aperture NPLC_TempRTD2w", "Visible"=FALSE)
        Property Node(instance in=reference to "Aperture Time_TempRTD4w", "Visible"=FALSE)
        Property Node(instance in=reference to "Aperture Time_TempRTD2w", "Visible"=FALSE)
        Property Node(instance in=reference to "Aperture_TempRTD4w", "Visible"=FALSE)
        Event Data() -> ("Old Value"=w6, "New Value"=w7)
        # EVENT NIE DLA
        # CONTROL NEW VALUE F
        # INDICATOR OLD
        Property Node(instance in=reference to "VoltageDC_indicator", "Visible"=w6)
        Property Node(instance in=reference to "Aperture_TempRTD2w", "Visible"=FALSE)
        Property Node(instance in=reference to "Units_TempRTD4w", "Visible"=FALSE)
        Property Node(instance in=reference to "CurrentDC_indicator", "Visible"=w6)
        Property Node(instance in=reference to "Units_TempRTD2w", "Visible"=FALSE)
        Property Node(instance in=reference to "String_TempRTD4w", "Visible"=FALSE)
        Property Node(instance in=reference to "String_TempRTD2w", "Visible"=FALSE)
        Property Node(instance in=reference to "CurrentAC_indicator", "Visible"=w6)
        Property Node(instance in=reference to "2WResistance_indicator", "Visible"=w6)
        Property Node(instance in=reference to "4WResistance_indicator", "Visible"=w6)
        Property Node(instance in=reference to "Frequency_indicator", "Visible"=w6)
        Property Node(instance in=reference to "Capacitance_indicator", "Visible"=w6)
        Property Node(instance in=reference to "Continuity_indicator", "Visible"=w6)
        Property Node(instance in=reference to "Diode_indicator", "Visible"=w6)
        Property Node(instance in=reference to "Temperature_indicator", "Visible"=w6)
        # EVENT DLA
        # CONTROL OLD
        # INDICATOR NEW
        Property Node(instance in=reference to "VoltageAC_control", "Visible"=w6)
        Property Node(instance in=reference to "VoltageAC_indicator", "Visible"=w7)
        Property Node(instance in=reference to "VoltageDC_control", "Visible"=w7, "Value"=FALSE)
        Property Node(instance in=reference to "CurrentDC_control", "Visible"=w7, "Value"=FALSE)
        Property Node(instance in=reference to "CurrentAC_control", "Visible"=w7, "Value"=FALSE)
        Property Node(instance in=reference to "2WResistance_control", "Visible"=w7, "Value"=FALSE)
        Property Node(instance in=reference to "4WResistance_control", "Visible"=w7, "Value"=FALSE)
        Property Node(instance in=reference to "Frequency_control", "Visible"=w7, "Value"=FALSE)
        Property Node(instance in=reference to "Capacitance_control", "Visible"=w7, "Value"=FALSE)
        Property Node(instance in=reference to "Continuity_control", "Visible"=w7, "Value"=FALSE)
        Property Node(instance in=reference to "Diode_control", "Visible"=w7, "Value"=FALSE)
        Property Node(instance in=reference to "Temperature_control", "Visible"=w7, "Value"=FALSE)
        w1 = default
      }
      on "CurrentDC_control" Value changed {
        # TITLES VISIBILITY
        Property Node(instance in=reference to unnamed text, "Visible"=FALSE)
        # DCV VISIBILITY
        Property Node(instance in=reference to "DIG Option On/Off_DCV", "Visible"=FALSE)
        # DCC VISIBILITY
        Property Node(instance in=reference to "TerminalType_DCC", "Visible"=TRUE)
        # ACV VISIBILITY
        Property Node(instance in=reference to "Manual Range_ACV", "Visible"=FALSE)
        Property Node(instance in=reference to unnamed text, "Visible"=FALSE)
        # DCVRATIO VISIBILITY
        Property Node(instance in=reference to "DIG Option On/Off_DCVR", "Visible"=FALSE)
        # 2WR VISIBILITY
        Property Node(instance in=reference to "Aperture NPLC_2WR", "Visible"=FALSE)
        # 4WR VISIBILITY
        Property Node(instance in=reference to "Aperture NPLC_4WR", "Visible"=FALSE)
        Property Node(instance in=reference to "Auto Impedance_DCV", "Visible"=FALSE)
        # ACC VISIBILITY
        Property Node(instance in=reference to "TerminalType_ACC", "Visible"=FALSE)
        Property Node(instance in=reference to "Auto Range_DCC", "Visible"=TRUE)
        # FREQ VISIBILITY
        Property Node(instance in=reference to "ACFilter_Freq", "Visible"=FALSE)
        # CAPACI VISIBILITY
        Property Node(instance in=reference to "Manual Range_Capaci", "Visible"=FALSE)
        Property Node(instance in=reference to unnamed text, "Visible"=FALSE)
        Property Node(instance in=reference to "Auto Impedance_DCVR", "Visible"=FALSE)
        Property Node(instance in=reference to "VoltageBandwidth_ACV", "Visible"=FALSE)
        Property Node(instance in=reference to "Aperture Time_2WR", "Visible"=FALSE)
        Property Node(instance in=reference to "Aperture Time_4WR", "Visible"=FALSE)
        Property Node(instance in=reference to "Manual Range_DCV", "Visible"=FALSE, "Disabled"=TRUE)
        Property Node(instance in=reference to "VoltageBandwidth_ACC", "Visible"=FALSE)
        Property Node(instance in=reference to "Manual Range_DCC", "Visible"=TRUE)
        Property Node(instance in=reference to "Auto Range_Freq", "Visible"=FALSE)
        Property Node(instance in=reference to "Auto Range_Capaci", "Visible"=FALSE)
        Property Node(instance in=reference to unnamed text, "Visible"=FALSE)
        Property Node(instance in=reference to "Manual Range_DCVR", "Visible"=FALSE)
        Property Node(instance in=reference to "String_ACV", "Visible"=FALSE)
        Property Node(instance in=reference to "Aperture_2WR", "Visible"=FALSE)
        Property Node(instance in=reference to "Aperture_4WR", "Visible"=FALSE)
        Property Node(instance in=reference to "Aperture NPLC_DCV", "Visible"=FALSE)
        Property Node(instance in=reference to "Manual Range_ACC", "Visible"=FALSE)
        Property Node(instance in=reference to "Aperture_DCC", "Visible"=TRUE)
        Property Node(instance in=reference to "GateTime_Freq", "Visible"=FALSE)
        Property Node(instance in=reference to "String_Capaci", "Visible"=FALSE)
        Property Node(instance in=reference to "Aperture NPLC_DCVR", "Visible"=FALSE)
        Property Node(instance in=reference to unnamed text, "Visible"=TRUE)
        Property Node(instance in=reference to "Auto Range_2WR", "Visible"=FALSE)
        Property Node(instance in=reference to "Auto Range_4WR", "Visible"=FALSE)
        Property Node(instance in=reference to "Auto Range_ACV", "Visible"=FALSE)
        Property Node(instance in=reference to "Aperture_DCV", "Visible"=FALSE)
        Property Node(instance in=reference to "Auto Range_ACC", "Visible"=FALSE)
        Property Node(instance in=reference to "Aperture NPLC_DCC", "Visible"=TRUE)
        Property Node(instance in=reference to "Manual Range_Freq", "Visible"=FALSE)
        Property Node(instance in=reference to "Aperture_DCVR", "Visible"=FALSE)
        Property Node(instance in=reference to unnamed text, "Visible"=FALSE)
        Property Node(instance in=reference to "Auto Zero_2WR", "Visible"=FALSE)
        Property Node(instance in=reference to "LowPower_4WR", "Visible"=FALSE)
        Property Node(instance in=reference to "Auto Range_DCV", "Visible"=FALSE)
        Property Node(instance in=reference to "String_ACC", "Visible"=FALSE)
        Property Node(instance in=reference to "Aperture Time_DCC", "Visible"=TRUE)
        Property Node(instance in=reference to "Timeout_Freq", "Visible"=FALSE)
        Property Node(instance in=reference to "Auto Range_DCVR", "Visible"=FALSE)
        Property Node(instance in=reference to unnamed text, "Visible"=FALSE)
        Property Node(instance in=reference to "LowPower_2WR", "Visible"=FALSE)
        Property Node(instance in=reference to "Manual Range_4WR", "Visible"=FALSE)
        Property Node(instance in=reference to "DCV Ratio_toenable", "Visible"=FALSE)
        Property Node(instance in=reference to "Auto Zero_DCC", "Visible"=TRUE)
        Property Node(instance in=reference to "String_Freq", "Visible"=FALSE)
        Property Node(instance in=reference to "DCV Ratio_todisable", "Visible"=FALSE)
        Property Node(instance in=reference to unnamed text, "Visible"=FALSE)
        Property Node(instance in=reference to "Manual Range_2WR", "Visible"=FALSE)
        Property Node(instance in=reference to "OffstComp_4WR", "Visible"=FALSE)
        Property Node(instance in=reference to "Aperture Time_DCV", "Visible"=FALSE)
        Property Node(instance in=reference to "Aperture Time_DCVR", "Visible"=FALSE)
        Property Node(instance in=reference to unnamed text, "Visible"=FALSE)
        Property Node(instance in=reference to "String_DCC", "Visible"=TRUE)
        Property Node(instance in=reference to "OffstComp_2WR", "Visible"=FALSE)
        Property Node(instance in=reference to "String_4WR", "Visible"=FALSE)
        Property Node(instance in=reference to "String_DCV", "Visible"=FALSE)
        Property Node(instance in=reference to "String_DCVR", "Visible"=FALSE)
        Property Node(instance in=reference to unnamed text, "Visible"=FALSE)
        Property Node(instance in=reference to "String_2WR", "Visible"=FALSE)
        Property Node(instance in=reference to "Auto Zero_DCV", "Visible"=FALSE)
        Property Node(instance in=reference to unnamed text, "Visible"=FALSE)
        # TEMPRTD2W VISIBILITY
        Property Node(instance in=reference to "Auto Zero_TempRTD2w", "Visible"=FALSE)
        Property Node(instance in=reference to unnamed text, "Visible"=FALSE)
        # TEMPRTD4W VISIBILITY
        Property Node(instance in=reference to "LowPower_TempRTD4w", "Visible"=FALSE)
        # TEMPMAIN VISIBILITY
        Property Node(instance in=reference to "Probe_TempMain", "Visible"=FALSE)
        # TEMPTHERMIS4W VISIBILITY
        Property Node(instance in=reference to "Aperture NPLC_TempThermis4w", "Visible"=FALSE)
        Property Node(instance in=reference to "LowPower_TempRTD2w", "Visible"=FALSE)
        Property Node(instance in=reference to unnamed text, "Visible"=FALSE)
        Property Node(instance in=reference to "OffstComp_TempRTD4w", "Visible"=FALSE)
        # TEMPTHERMIS2W VISIBILITY
        Property Node(instance in=reference to "Aperture NPLC_TempThermis2w", "Visible"=FALSE)
        # CONT VISIBILITY
        Property Node(instance in=reference to "Beeper_Cont", "Visible"=FALSE)
        # DIODE VISIBILITY
        Property Node(instance in=reference to "Beeper_Diode", "Visible"=FALSE)
        Property Node(instance in=reference to "Aperture Time_TempThermis4w", "Visible"=FALSE)
        Property Node(instance in=reference to "OffstComp_TempRTD2w", "Visible"=FALSE)
        Property Node(instance in=reference to "Aperture Time_TempThermis2w", "Visible"=FALSE)
        Property Node(instance in=reference to "R0_TempRTD4w", "Visible"=FALSE)
        Property Node(instance in=reference to "String_Cont", "Visible"=FALSE)
        Property Node(instance in=reference to "String_Diode", "Visible"=FALSE)
        Property Node(instance in=reference to "Aperture_TempThermis4w", "Visible"=FALSE)
        Property Node(instance in=reference to "Aperture_TempThermis2w", "Visible"=FALSE)
        Property Node(instance in=reference to "R0_TempRTD2w", "Visible"=FALSE)
        Property Node(instance in=reference to "Aperture NPLC_TempRTD4w", "Visible"=FALSE)
        Property Node(instance in=reference to "LowPower_TempThermis4w", "Visible"=FALSE)
        Property Node(instance in=reference to "Auto Zero_TempThermis2w", "Visible"=FALSE)
        Property Node(instance in=reference to "Aperture NPLC_TempRTD2w", "Visible"=FALSE)
        Property Node(instance in=reference to "Aperture Time_TempRTD4w", "Visible"=FALSE)
        Event Data() -> ("Old Value"=w8, "New Value"=w9)
        # EVENT NIE DLA
        # CONTROL NEW VALUE F
        # INDICATOR OLD
        Property Node(instance in=reference to "VoltageAC_indicator", "Visible"=w8)
        Property Node(instance in=reference to "Units_TempThermis4w", "Visible"=FALSE)
        Property Node(instance in=reference to "LowPower_TempThermis2w", "Visible"=FALSE)
        Property Node(instance in=reference to "Aperture Time_TempRTD2w", "Visible"=FALSE)
        Property Node(instance in=reference to "Aperture_TempRTD4w", "Visible"=FALSE)
        Property Node(instance in=reference to "VoltageDC_indicator", "Visible"=w8)
        Property Node(instance in=reference to "String_TempThermis4w", "Visible"=FALSE)
        Property Node(instance in=reference to "Units_TempThermis2w", "Visible"=FALSE)
        Property Node(instance in=reference to "Aperture_TempRTD2w", "Visible"=FALSE)
        Property Node(instance in=reference to "Units_TempRTD4w", "Visible"=FALSE)
        Property Node(instance in=reference to "String_TempThermis2w", "Visible"=FALSE)
        Property Node(instance in=reference to "Units_TempRTD2w", "Visible"=FALSE)
        Property Node(instance in=reference to "CurrentAC_indicator", "Visible"=w8)
        Property Node(instance in=reference to "String_TempRTD4w", "Visible"=FALSE)
        Property Node(instance in=reference to "String_TempRTD2w", "Visible"=FALSE)
        Property Node(instance in=reference to "2WResistance_indicator", "Visible"=w8)
        Property Node(instance in=reference to "4WResistance_indicator", "Visible"=w8)
        Property Node(instance in=reference to "Frequency_indicator", "Visible"=w8)
        Property Node(instance in=reference to "Capacitance_indicator", "Visible"=w8)
        Property Node(instance in=reference to "Continuity_indicator", "Visible"=w8)
        Property Node(instance in=reference to "Diode_indicator", "Visible"=w8)
        Property Node(instance in=reference to "Temperature_indicator", "Visible"=w8)
        # EVENT DLA
        # CONTROL OLD
        # INDICATOR NEW
        Property Node(instance in=reference to "CurrentDC_control", "Visible"=w8)
        Property Node(instance in=reference to "CurrentDC_indicator", "Visible"=w9)
        Property Node(instance in=reference to "VoltageAC_control", "Visible"=w9, "Value"=FALSE)
        Property Node(instance in=reference to "VoltageDC_control", "Visible"=w9, "Value"=FALSE)
        Property Node(instance in=reference to "CurrentAC_control", "Visible"=w9, "Value"=FALSE)
        Property Node(instance in=reference to "2WResistance_control", "Visible"=w9, "Value"=FALSE)
        Property Node(instance in=reference to "4WResistance_control", "Visible"=w9, "Value"=FALSE)
        Property Node(instance in=reference to "Frequency_control", "Visible"=w9, "Value"=FALSE)
        Property Node(instance in=reference to "Capacitance_control", "Visible"=w9, "Value"=FALSE)
        Property Node(instance in=reference to "Continuity_control", "Visible"=w9, "Value"=FALSE)
        Property Node(instance in=reference to "Diode_control", "Visible"=w9, "Value"=FALSE)
        Property Node(instance in=reference to "Temperature_control", "Visible"=w9, "Value"=FALSE)
        w1 = default
      }
      on "CurrentAC_control" Value changed {
        # TITLES VISIBILITY
        Property Node(instance in=reference to unnamed text, "Visible"=FALSE)
        # DCV VISIBILITY
        Property Node(instance in=reference to "DIG Option On/Off_DCV", "Visible"=FALSE)
        # DCC VISIBILITY
        Property Node(instance in=reference to "TerminalType_DCC", "Visible"=FALSE)
        # ACV VISIBILITY
        Property Node(instance in=reference to "Manual Range_ACV", "Visible"=FALSE)
        Property Node(instance in=reference to unnamed text, "Visible"=FALSE)
        # DCVRATIO VISIBILITY
        Property Node(instance in=reference to "DIG Option On/Off_DCVR", "Visible"=FALSE)
        # 2WR VISIBILITY
        Property Node(instance in=reference to "Aperture NPLC_2WR", "Visible"=FALSE)
        # 4WR VISIBILITY
        Property Node(instance in=reference to "Aperture NPLC_4WR", "Visible"=FALSE)
        Property Node(instance in=reference to "Auto Impedance_DCV", "Visible"=FALSE)
        # ACC VISIBILITY
        Property Node(instance in=reference to "TerminalType_ACC", "Visible"=TRUE)
        Property Node(instance in=reference to "Auto Range_DCC", "Visible"=FALSE)
        # FREQ VISIBILITY
        Property Node(instance in=reference to "ACFilter_Freq", "Visible"=FALSE)
        Property Node(instance in=reference to unnamed text, "Visible"=FALSE)
        Property Node(instance in=reference to "Auto Impedance_DCVR", "Visible"=FALSE)
        Property Node(instance in=reference to "VoltageBandwidth_ACV", "Visible"=FALSE)
        # CAPACI VISIBILITY
        Property Node(instance in=reference to "Manual Range_Capaci", "Visible"=FALSE)
        Property Node(instance in=reference to "Aperture Time_2WR", "Visible"=FALSE)
        Property Node(instance in=reference to "Aperture Time_4WR", "Visible"=FALSE)
        Property Node(instance in=reference to "Manual Range_DCV", "Visible"=FALSE, "Disabled"=TRUE)
        Property Node(instance in=reference to "VoltageBandwidth_ACC", "Visible"=TRUE)
        Property Node(instance in=reference to "Manual Range_DCC", "Visible"=FALSE)
        Property Node(instance in=reference to "Auto Range_Freq", "Visible"=FALSE)
        Property Node(instance in=reference to unnamed text, "Visible"=FALSE)
        Property Node(instance in=reference to "Manual Range_DCVR", "Visible"=FALSE)
        Property Node(instance in=reference to "String_ACV", "Visible"=FALSE)
        Property Node(instance in=reference to "Auto Range_Capaci", "Visible"=FALSE)
        Property Node(instance in=reference to "Aperture_2WR", "Visible"=FALSE)
        Property Node(instance in=reference to "Aperture_4WR", "Visible"=FALSE)
        Property Node(instance in=reference to "Aperture NPLC_DCV", "Visible"=FALSE)
        Property Node(instance in=reference to "Manual Range_ACC", "Visible"=TRUE)
        Property Node(instance in=reference to "Aperture_DCC", "Visible"=FALSE)
        Property Node(instance in=reference to "GateTime_Freq", "Visible"=FALSE)
        Property Node(instance in=reference to "Aperture NPLC_DCVR", "Visible"=FALSE)
        Property Node(instance in=reference to "String_Capaci", "Visible"=FALSE)
        Property Node(instance in=reference to unnamed text, "Visible"=FALSE)
        Property Node(instance in=reference to "Auto Range_2WR", "Visible"=FALSE)
        Property Node(instance in=reference to "Auto Range_ACV", "Visible"=FALSE)
        Property Node(instance in=reference to "Auto Range_4WR", "Visible"=FALSE)
        Property Node(instance in=reference to "Aperture_DCV", "Visible"=FALSE)
        Property Node(instance in=reference to "Auto Range_ACC", "Visible"=TRUE)
        Property Node(instance in=reference to "Aperture NPLC_DCC", "Visible"=FALSE)
        Property Node(instance in=reference to "Manual Range_Freq", "Visible"=FALSE)
        Property Node(instance in=reference to "Aperture_DCVR", "Visible"=FALSE)
        Property Node(instance in=reference to unnamed text, "Visible"=TRUE)
        Property Node(instance in=reference to "Auto Zero_2WR", "Visible"=FALSE)
        Property Node(instance in=reference to "LowPower_4WR", "Visible"=FALSE)
        Property Node(instance in=reference to "Auto Range_DCV", "Visible"=FALSE)
        Property Node(instance in=reference to "String_ACC", "Visible"=TRUE)
        Property Node(instance in=reference to "Aperture Time_DCC", "Visible"=FALSE)
        Property Node(instance in=reference to "Timeout_Freq", "Visible"=FALSE)
        Property Node(instance in=reference to "Auto Range_DCVR", "Visible"=FALSE)
        Property Node(instance in=reference to unnamed text, "Visible"=FALSE)
        Property Node(instance in=reference to "LowPower_2WR", "Visible"=FALSE)
        Property Node(instance in=reference to "Manual Range_4WR", "Visible"=FALSE)
        Property Node(instance in=reference to "DCV Ratio_toenable", "Visible"=FALSE)
        Property Node(instance in=reference to "Auto Zero_DCC", "Visible"=FALSE)
        Property Node(instance in=reference to "String_Freq", "Visible"=FALSE)
        Property Node(instance in=reference to "DCV Ratio_todisable", "Visible"=FALSE)
        Property Node(instance in=reference to unnamed text, "Visible"=FALSE)
        Property Node(instance in=reference to "Manual Range_2WR", "Visible"=FALSE)
        Property Node(instance in=reference to "OffstComp_4WR", "Visible"=FALSE)
        Property Node(instance in=reference to "Aperture Time_DCV", "Visible"=FALSE)
        Property Node(instance in=reference to "Aperture Time_DCVR", "Visible"=FALSE)
        Property Node(instance in=reference to unnamed text, "Visible"=FALSE)
        Property Node(instance in=reference to "String_DCC", "Visible"=FALSE)
        Property Node(instance in=reference to "OffstComp_2WR", "Visible"=FALSE)
        Property Node(instance in=reference to "String_4WR", "Visible"=FALSE)
        Property Node(instance in=reference to "String_DCV", "Visible"=FALSE)
        Property Node(instance in=reference to "String_DCVR", "Visible"=FALSE)
        Property Node(instance in=reference to unnamed text, "Visible"=FALSE)
        Property Node(instance in=reference to "String_2WR", "Visible"=FALSE)
        Property Node(instance in=reference to "Auto Zero_DCV", "Visible"=FALSE)
        Property Node(instance in=reference to unnamed text, "Visible"=FALSE)
        Property Node(instance in=reference to unnamed text, "Visible"=FALSE)
        # CONT VISIBILITY
        Property Node(instance in=reference to "Beeper_Cont", "Visible"=FALSE)
        # DIODE VISIBILITY
        Property Node(instance in=reference to "Beeper_Diode", "Visible"=FALSE)
        # TEMPRTD2W VISIBILITY
        Property Node(instance in=reference to "Auto Zero_TempRTD2w", "Visible"=FALSE)
        # TEMPRTD4W VISIBILITY
        Property Node(instance in=reference to "LowPower_TempRTD4w", "Visible"=FALSE)
        # TEMPTHERMIS4W VISIBILITY
        Property Node(instance in=reference to "Aperture NPLC_TempThermis4w", "Visible"=FALSE)
        Property Node(instance in=reference to unnamed text, "Visible"=FALSE)
        # TEMPTHERMIS2W VISIBILITY
        Property Node(instance in=reference to "Aperture NPLC_TempThermis2w", "Visible"=FALSE)
        Property Node(instance in=reference to "String_Cont", "Visible"=FALSE)
        # TEMPMAIN VISIBILITY
        Property Node(instance in=reference to "Probe_TempMain", "Visible"=FALSE)
        Property Node(instance in=reference to "String_Diode", "Visible"=FALSE)
        Property Node(instance in=reference to "LowPower_TempRTD2w", "Visible"=FALSE)
        Property Node(instance in=reference to "OffstComp_TempRTD4w", "Visible"=FALSE)
        Property Node(instance in=reference to "Aperture Time_TempThermis4w", "Visible"=FALSE)
        Property Node(instance in=reference to "Aperture Time_TempThermis2w", "Visible"=FALSE)
        Property Node(instance in=reference to "OffstComp_TempRTD2w", "Visible"=FALSE)
        Property Node(instance in=reference to "R0_TempRTD4w", "Visible"=FALSE)
        Property Node(instance in=reference to "Aperture_TempThermis4w", "Visible"=FALSE)
        Property Node(instance in=reference to "Aperture_TempThermis2w", "Visible"=FALSE)
        Property Node(instance in=reference to "R0_TempRTD2w", "Visible"=FALSE)
        Property Node(instance in=reference to "Aperture NPLC_TempRTD4w", "Visible"=FALSE)
        Property Node(instance in=reference to "LowPower_TempThermis4w", "Visible"=FALSE)
        Property Node(instance in=reference to "Auto Zero_TempThermis2w", "Visible"=FALSE)
        Event Data() -> ("Old Value"=w10, "New Value"=w11)
        # EVENT NIE DLA
        # CONTROL NEW VALUE F
        # INDICATOR OLD
        Property Node(instance in=reference to "VoltageAC_indicator", "Visible"=w10)
        Property Node(instance in=reference to "Aperture NPLC_TempRTD2w", "Visible"=FALSE)
        Property Node(instance in=reference to "Aperture Time_TempRTD4w", "Visible"=FALSE)
        Property Node(instance in=reference to "Units_TempThermis4w", "Visible"=FALSE)
        Property Node(instance in=reference to "LowPower_TempThermis2w", "Visible"=FALSE)
        Property Node(instance in=reference to "Aperture Time_TempRTD2w", "Visible"=FALSE)
        Property Node(instance in=reference to "CurrentDC_indicator", "Visible"=w10)
        Property Node(instance in=reference to "Aperture_TempRTD4w", "Visible"=FALSE)
        Property Node(instance in=reference to "String_TempThermis4w", "Visible"=FALSE)
        Property Node(instance in=reference to "Units_TempThermis2w", "Visible"=FALSE)
        Property Node(instance in=reference to "Aperture_TempRTD2w", "Visible"=FALSE)
        Property Node(instance in=reference to "Units_TempRTD4w", "Visible"=FALSE)
        Property Node(instance in=reference to "String_TempThermis2w", "Visible"=FALSE)
        Property Node(instance in=reference to "VoltageDC_indicator", "Visible"=w10)
        Property Node(instance in=reference to "Units_TempRTD2w", "Visible"=FALSE)
        Property Node(instance in=reference to "String_TempRTD4w", "Visible"=FALSE)
        Property Node(instance in=reference to "2WResistance_indicator", "Visible"=w10)
        Property Node(instance in=reference to "String_TempRTD2w", "Visible"=FALSE)
        Property Node(instance in=reference to "4WResistance_indicator", "Visible"=w10)
        Property Node(instance in=reference to "Frequency_indicator", "Visible"=w10)
        Property Node(instance in=reference to "Capacitance_indicator", "Visible"=w10)
        Property Node(instance in=reference to "Continuity_indicator", "Visible"=w10)
        Property Node(instance in=reference to "Diode_indicator", "Visible"=w10)
        Property Node(instance in=reference to "Temperature_indicator", "Visible"=w10)
        # EVENT DLA
        # CONTROL OLD
        # INDICATOR NEW
        Property Node(instance in=reference to "CurrentAC_control", "Visible"=w10)
        Property Node(instance in=reference to "CurrentAC_indicator", "Visible"=w11)
        Property Node(instance in=reference to "VoltageAC_control", "Visible"=w11, "Value"=FALSE)
        Property Node(instance in=reference to "CurrentDC_control", "Visible"=w11, "Value"=FALSE)
        Property Node(instance in=reference to "VoltageDC_control", "Visible"=w11, "Value"=FALSE)
        Property Node(instance in=reference to "2WResistance_control", "Visible"=w11, "Value"=FALSE)
        Property Node(instance in=reference to "4WResistance_control", "Visible"=w11, "Value"=FALSE)
        Property Node(instance in=reference to "Frequency_control", "Visible"=w11, "Value"=FALSE)
        Property Node(instance in=reference to "Capacitance_control", "Visible"=w11, "Value"=FALSE)
        Property Node(instance in=reference to "Continuity_control", "Visible"=w11, "Value"=FALSE)
        Property Node(instance in=reference to "Diode_control", "Visible"=w11, "Value"=FALSE)
        Property Node(instance in=reference to "Temperature_control", "Visible"=w11, "Value"=FALSE)
        w1 = default
      }
      on "2WResistance_control" Value changed {
        # TITLES VISIBILITY
        Property Node(instance in=reference to unnamed text, "Visible"=FALSE)
        # 2WR VISIBILITY
        Property Node(instance in=reference to "Aperture NPLC_2WR", "Visible"=TRUE)
        # 4WR VISIBILITY
        Property Node(instance in=reference to "Aperture NPLC_4WR", "Visible"=FALSE)
        # DCV VISIBILITY
        Property Node(instance in=reference to "DIG Option On/Off_DCV", "Visible"=FALSE)
        # DCC VISIBILITY
        Property Node(instance in=reference to "TerminalType_DCC", "Visible"=FALSE)
        # ACV VISIBILITY
        Property Node(instance in=reference to "Manual Range_ACV", "Visible"=FALSE)
        Property Node(instance in=reference to unnamed text, "Visible"=FALSE)
        # DCVRATIO VISIBILITY
        Property Node(instance in=reference to "DIG Option On/Off_DCVR", "Visible"=FALSE)
        # FREQ VISIBILITY
        Property Node(instance in=reference to "ACFilter_Freq", "Visible"=FALSE)
        Property Node(instance in=reference to "Aperture Time_2WR", "Visible"=TRUE)
        Property Node(instance in=reference to "Aperture Time_4WR", "Visible"=FALSE)
        # CAPACI VISIBILITY
        Property Node(instance in=reference to "Manual Range_Capaci", "Visible"=FALSE)
        Property Node(instance in=reference to "Auto Impedance_DCV", "Visible"=FALSE)
        # ACC VISIBILITY
        Property Node(instance in=reference to "TerminalType_ACC", "Visible"=FALSE)
        Property Node(instance in=reference to "Auto Range_DCC", "Visible"=FALSE)
        Property Node(instance in=reference to unnamed text, "Visible"=FALSE)
        Property Node(instance in=reference to "Auto Impedance_DCVR", "Visible"=FALSE)
        Property Node(instance in=reference to "Auto Range_Freq", "Visible"=FALSE)
        Property Node(instance in=reference to "VoltageBandwidth_ACV", "Visible"=FALSE)
        Property Node(instance in=reference to "Aperture_2WR", "Visible"=TRUE)
        Property Node(instance in=reference to "Aperture_4WR", "Visible"=FALSE)
        Property Node(instance in=reference to "Auto Range_Capaci", "Visible"=FALSE)
        Property Node(instance in=reference to "Manual Range_DCV", "Visible"=FALSE, "Disabled"=TRUE)
        Property Node(instance in=reference to "VoltageBandwidth_ACC", "Visible"=FALSE)
        Property Node(instance in=reference to "Manual Range_DCC", "Visible"=FALSE)
        Property Node(instance in=reference to unnamed text, "Visible"=FALSE)
        Property Node(instance in=reference to "Manual Range_DCVR", "Visible"=FALSE)
        Property Node(instance in=reference to "GateTime_Freq", "Visible"=FALSE)
        Property Node(instance in=reference to "String_ACV", "Visible"=FALSE)
        Property Node(instance in=reference to "Auto Range_2WR", "Visible"=TRUE)
        Property Node(instance in=reference to "Auto Range_4WR", "Visible"=FALSE)
        Property Node(instance in=reference to "String_Capaci", "Visible"=FALSE)
        Property Node(instance in=reference to "Aperture NPLC_DCV", "Visible"=FALSE)
        Property Node(instance in=reference to "Manual Range_ACC", "Visible"=FALSE)
        Property Node(instance in=reference to "Aperture_DCC", "Visible"=FALSE)
        Property Node(instance in=reference to "Aperture NPLC_DCVR", "Visible"=FALSE)
        Property Node(instance in=reference to "Manual Range_Freq", "Visible"=FALSE)
        Property Node(instance in=reference to "Auto Zero_2WR", "Visible"=TRUE)
        Property Node(instance in=reference to unnamed text, "Visible"=FALSE)
        Property Node(instance in=reference to "Auto Range_ACV", "Visible"=FALSE)
        Property Node(instance in=reference to "LowPower_4WR", "Visible"=FALSE)
        Property Node(instance in=reference to "Aperture_DCV", "Visible"=FALSE)
        Property Node(instance in=reference to "Auto Range_ACC", "Visible"=FALSE)
        Property Node(instance in=reference to "Aperture NPLC_DCC", "Visible"=FALSE)
        Property Node(instance in=reference to "Aperture_DCVR", "Visible"=FALSE)
        Property Node(instance in=reference to "Timeout_Freq", "Visible"=FALSE)
        Property Node(instance in=reference to "LowPower_2WR", "Visible"=TRUE)
        Property Node(instance in=reference to unnamed text, "Visible"=FALSE)
        Property Node(instance in=reference to "Manual Range_4WR", "Visible"=FALSE)
        Property Node(instance in=reference to "Auto Range_DCV", "Visible"=FALSE)
        Property Node(instance in=reference to "String_ACC", "Visible"=FALSE)
        Property Node(instance in=reference to "Aperture Time_DCC", "Visible"=FALSE)
        Property Node(instance in=reference to "Auto Range_DCVR", "Visible"=FALSE)
        Property Node(instance in=reference to "String_Freq", "Visible"=FALSE)
        Property Node(instance in=reference to "Manual Range_2WR", "Visible"=TRUE)
        Property Node(instance in=reference to unnamed text, "Visible"=TRUE)
        Property Node(instance in=reference to "OffstComp_4WR", "Visible"=FALSE)
        Property Node(instance in=reference to "DCV Ratio_toenable", "Visible"=FALSE)
        Property Node(instance in=reference to "Auto Zero_DCC", "Visible"=FALSE)
        Property Node(instance in=reference to "DCV Ratio_todisable", "Visible"=FALSE)
        Property Node(instance in=reference to "OffstComp_2WR", "Visible"=TRUE)
        Property Node(instance in=reference to unnamed text, "Visible"=FALSE)
        Property Node(instance in=reference to "String_4WR", "Visible"=FALSE)
        Property Node(instance in=reference to "Aperture Time_DCV", "Visible"=FALSE)
        Property Node(instance in=reference to "Aperture Time_DCVR", "Visible"=FALSE)
        Property Node(instance in=reference to "String_2WR", "Visible"=TRUE)
        Property Node(instance in=reference to unnamed text, "Visible"=FALSE)
        Property Node(instance in=reference to "String_DCC", "Visible"=FALSE)
        Property Node(instance in=reference to "String_DCV", "Visible"=FALSE)
        # CONT VISIBILITY
        Property Node(instance in=reference to "String_DCVR", "Visible"=FALSE)
        Property Node(instance in=reference to unnamed text, "Visible"=FALSE)
        Property Node(instance in=reference to "Auto Zero_DCV", "Visible"=FALSE)
        Property Node(instance in=reference to unnamed text, "Visible"=FALSE)
        # TEMPRTD2W VISIBILITY
        Property Node(instance in=reference to "Auto Zero_TempRTD2w", "Visible"=FALSE)
        # TEMPRTD4W VISIBILITY
        Property Node(instance in=reference to "LowPower_TempRTD4w", "Visible"=FALSE)
        Property Node(instance in=reference to "Beeper_Cont", "Visible"=FALSE)
        # DIODE VISIBILITY
        Property Node(instance in=reference to "Beeper_Diode", "Visible"=FALSE)
        # TEMPTHERMIS4W VISIBILITY
        Property Node(instance in=reference to "Aperture NPLC_TempThermis4w", "Visible"=FALSE)
        Property Node(instance in=reference to unnamed text, "Visible"=FALSE)
        # TEMPMAIN VISIBILITY
        Property Node(instance in=reference to "Probe_TempMain", "Visible"=FALSE)
        # TEMPTHERMIS2W VISIBILITY
        Property Node(instance in=reference to "Aperture NPLC_TempThermis2w", "Visible"=FALSE)
        Property Node(instance in=reference to "LowPower_TempRTD2w", "Visible"=FALSE)
        Property Node(instance in=reference to "OffstComp_TempRTD4w", "Visible"=FALSE)
        Property Node(instance in=reference to "String_Cont", "Visible"=FALSE)
        Property Node(instance in=reference to "String_Diode", "Visible"=FALSE)
        Property Node(instance in=reference to "Aperture Time_TempThermis4w", "Visible"=FALSE)
        Property Node(instance in=reference to unnamed text, "Visible"=FALSE)
        Property Node(instance in=reference to "Aperture Time_TempThermis2w", "Visible"=FALSE)
        Property Node(instance in=reference to "OffstComp_TempRTD2w", "Visible"=FALSE)
        Property Node(instance in=reference to "R0_TempRTD4w", "Visible"=FALSE)
        Property Node(instance in=reference to "Aperture_TempThermis4w", "Visible"=FALSE)
        Property Node(instance in=reference to "Aperture_TempThermis2w", "Visible"=FALSE)
        Property Node(instance in=reference to "R0_TempRTD2w", "Visible"=FALSE)
        Property Node(instance in=reference to "Aperture NPLC_TempRTD4w", "Visible"=FALSE)
        Property Node(instance in=reference to "LowPower_TempThermis4w", "Visible"=FALSE)
        Property Node(instance in=reference to "Auto Zero_TempThermis2w", "Visible"=FALSE)
        Property Node(instance in=reference to "Aperture NPLC_TempRTD2w", "Visible"=FALSE)
        Property Node(instance in=reference to "Aperture Time_TempRTD4w", "Visible"=FALSE)
        Property Node(instance in=reference to "Units_TempThermis4w", "Visible"=FALSE)
        Property Node(instance in=reference to "LowPower_TempThermis2w", "Visible"=FALSE)
        Property Node(instance in=reference to "Aperture Time_TempRTD2w", "Visible"=FALSE)
        Event Data() -> ("Old Value"=w12, "New Value"=w13)
        # EVENT NIE DLA
        # CONTROL NEW VALUE F
        # INDICATOR OLD
        Property Node(instance in=reference to "VoltageAC_indicator", "Visible"=w12)
        Property Node(instance in=reference to "Aperture_TempRTD4w", "Visible"=FALSE)
        Property Node(instance in=reference to "String_TempThermis4w", "Visible"=FALSE)
        Property Node(instance in=reference to "Units_TempThermis2w", "Visible"=FALSE)
        Property Node(instance in=reference to "Aperture_TempRTD2w", "Visible"=FALSE)
        Property Node(instance in=reference to "Units_TempRTD4w", "Visible"=FALSE)
        Property Node(instance in=reference to "CurrentDC_indicator", "Visible"=w12)
        Property Node(instance in=reference to "String_TempThermis2w", "Visible"=FALSE)
        Property Node(instance in=reference to "Units_TempRTD2w", "Visible"=FALSE)
        Property Node(instance in=reference to "String_TempRTD4w", "Visible"=FALSE)
        Property Node(instance in=reference to "CurrentAC_indicator", "Visible"=w12)
        Property Node(instance in=reference to "String_TempRTD2w", "Visible"=FALSE)
        Property Node(instance in=reference to "VoltageDC_indicator", "Visible"=w12)
        Property Node(instance in=reference to "4WResistance_indicator", "Visible"=w12)
        Property Node(instance in=reference to "Frequency_indicator", "Visible"=w12)
        Property Node(instance in=reference to "Capacitance_indicator", "Visible"=w12)
        Property Node(instance in=reference to "Continuity_indicator", "Visible"=w12)
        Property Node(instance in=reference to "Diode_indicator", "Visible"=w12)
        Property Node(instance in=reference to "Temperature_indicator", "Visible"=w12)
        # EVENT DLA
        # CONTROL OLD
        # INDICATOR NEW
        Property Node(instance in=reference to "2WResistance_control", "Visible"=w12)
        Property Node(instance in=reference to "2WResistance_indicator", "Visible"=w13)
        Property Node(instance in=reference to "VoltageAC_control", "Visible"=w13, "Value"=FALSE)
        Property Node(instance in=reference to "CurrentDC_control", "Visible"=w13, "Value"=FALSE)
        Property Node(instance in=reference to "CurrentAC_control", "Visible"=w13, "Value"=FALSE)
        Property Node(instance in=reference to "VoltageDC_control", "Visible"=w13, "Value"=FALSE)
        Property Node(instance in=reference to "4WResistance_control", "Visible"=w13, "Value"=FALSE)
        Property Node(instance in=reference to "Frequency_control", "Visible"=w13, "Value"=FALSE)
        Property Node(instance in=reference to "Capacitance_control", "Visible"=w13, "Value"=FALSE)
        Property Node(instance in=reference to "Continuity_control", "Visible"=w13, "Value"=FALSE)
        Property Node(instance in=reference to "Diode_control", "Visible"=w13, "Value"=FALSE)
        Property Node(instance in=reference to "Temperature_control", "Visible"=w13, "Value"=FALSE)
        w1 = default
      }
      on "4WResistance_control" Value changed {
        # TITLES VISIBILITY
        Property Node(instance in=reference to unnamed text, "Visible"=FALSE)
        # DCV VISIBILITY
        Property Node(instance in=reference to "DIG Option On/Off_DCV", "Visible"=FALSE)
        # DCC VISIBILITY
        Property Node(instance in=reference to "TerminalType_DCC", "Visible"=FALSE)
        # ACV VISIBILITY
        Property Node(instance in=reference to "Manual Range_ACV", "Visible"=FALSE)
        Property Node(instance in=reference to unnamed text, "Visible"=FALSE)
        # DCVRATIO VISIBILITY
        Property Node(instance in=reference to "DIG Option On/Off_DCVR", "Visible"=FALSE)
        Property Node(instance in=reference to "Auto Impedance_DCV", "Visible"=FALSE)
        # ACC VISIBILITY
        Property Node(instance in=reference to "TerminalType_ACC", "Visible"=FALSE)
        # 4WR VISIBILITY
        Property Node(instance in=reference to "Aperture NPLC_4WR", "Visible"=TRUE)
        Property Node(instance in=reference to "Auto Range_DCC", "Visible"=FALSE)
        # 2WR VISIBILITY
        Property Node(instance in=reference to "Aperture NPLC_2WR", "Visible"=FALSE)
        Property Node(instance in=reference to unnamed text, "Visible"=FALSE)
        Property Node(instance in=reference to "Auto Impedance_DCVR", "Visible"=FALSE)
        Property Node(instance in=reference to "VoltageBandwidth_ACV", "Visible"=FALSE)
        # FREQ VISIBILITY
        Property Node(instance in=reference to "ACFilter_Freq", "Visible"=FALSE)
        Property Node(instance in=reference to "Manual Range_DCV", "Visible"=FALSE, "Disabled"=TRUE)
        Property Node(instance in=reference to "VoltageBandwidth_ACC", "Visible"=FALSE)
        Property Node(instance in=reference to "Aperture Time_4WR", "Visible"=TRUE)
        Property Node(instance in=reference to "Manual Range_DCC", "Visible"=FALSE)
        Property Node(instance in=reference to "Aperture Time_2WR", "Visible"=FALSE)
        Property Node(instance in=reference to unnamed text, "Visible"=FALSE)
        Property Node(instance in=reference to "Manual Range_DCVR", "Visible"=FALSE)
        # CAPACI VISIBILITY
        Property Node(instance in=reference to "Manual Range_Capaci", "Visible"=FALSE)
        Property Node(instance in=reference to "String_ACV", "Visible"=FALSE)
        Property Node(instance in=reference to "Auto Range_Freq", "Visible"=FALSE)
        Property Node(instance in=reference to "Aperture NPLC_DCV", "Visible"=FALSE)
        Property Node(instance in=reference to "Manual Range_ACC", "Visible"=FALSE)
        Property Node(instance in=reference to "Aperture_4WR", "Visible"=TRUE)
        Property Node(instance in=reference to "Aperture_DCC", "Visible"=FALSE)
        Property Node(instance in=reference to "Aperture_2WR", "Visible"=FALSE)
        Property Node(instance in=reference to "Aperture NPLC_DCVR", "Visible"=FALSE)
        Property Node(instance in=reference to "Auto Range_Capaci", "Visible"=FALSE)
        Property Node(instance in=reference to unnamed text, "Visible"=FALSE)
        Property Node(instance in=reference to "GateTime_Freq", "Visible"=FALSE)
        Property Node(instance in=reference to "Auto Range_ACV", "Visible"=FALSE)
        Property Node(instance in=reference to "Aperture_DCV", "Visible"=FALSE)
        Property Node(instance in=reference to "Auto Range_ACC", "Visible"=FALSE)
        Property Node(instance in=reference to "Auto Range_4WR", "Visible"=TRUE)
        Property Node(instance in=reference to "Aperture NPLC_DCC", "Visible"=FALSE)
        Property Node(instance in=reference to "Auto Range_2WR", "Visible"=FALSE)
        Property Node(instance in=reference to "Aperture_DCVR", "Visible"=FALSE)
        Property Node(instance in=reference to "String_Capaci", "Visible"=FALSE)
        Property Node(instance in=reference to unnamed text, "Visible"=FALSE)
        Property Node(instance in=reference to "Manual Range_Freq", "Visible"=FALSE)
        Property Node(instance in=reference to "Auto Range_DCV", "Visible"=FALSE)
        Property Node(instance in=reference to "String_ACC", "Visible"=FALSE)
        Property Node(instance in=reference to "LowPower_4WR", "Visible"=TRUE)
        Property Node(instance in=reference to "Aperture Time_DCC", "Visible"=FALSE)
        Property Node(instance in=reference to "Auto Zero_2WR", "Visible"=FALSE)
        Property Node(instance in=reference to "Auto Range_DCVR", "Visible"=FALSE)
        Property Node(instance in=reference to unnamed text, "Visible"=FALSE)
        Property Node(instance in=reference to "Timeout_Freq", "Visible"=FALSE)
        Property Node(instance in=reference to "DCV Ratio_toenable", "Visible"=FALSE)
        Property Node(instance in=reference to "Manual Range_4WR", "Visible"=TRUE)
        Property Node(instance in=reference to "Auto Zero_DCC", "Visible"=FALSE)
        Property Node(instance in=reference to "LowPower_2WR", "Visible"=FALSE)
        Property Node(instance in=reference to "DCV Ratio_todisable", "Visible"=FALSE)
        Property Node(instance in=reference to unnamed text, "Visible"=TRUE)
        Property Node(instance in=reference to "String_Freq", "Visible"=FALSE)
        Property Node(instance in=reference to "Aperture Time_DCV", "Visible"=FALSE)
        Property Node(instance in=reference to "OffstComp_4WR", "Visible"=TRUE)
        Property Node(instance in=reference to "Manual Range_2WR", "Visible"=FALSE)
        Property Node(instance in=reference to "Aperture Time_DCVR", "Visible"=FALSE)
        Property Node(instance in=reference to unnamed text, "Visible"=FALSE)
        Property Node(instance in=reference to "String_DCC", "Visible"=FALSE)
        Property Node(instance in=reference to "String_DCV", "Visible"=FALSE)
        Property Node(instance in=reference to "String_4WR", "Visible"=TRUE)
        Property Node(instance in=reference to "OffstComp_2WR", "Visible"=FALSE)
        # CONT VISIBILITY
        Property Node(instance in=reference to "String_DCVR", "Visible"=FALSE)
        Property Node(instance in=reference to unnamed text, "Visible"=FALSE)
        Property Node(instance in=reference to "Auto Zero_DCV", "Visible"=FALSE)
        Property Node(instance in=reference to "String_2WR", "Visible"=FALSE)
        Property Node(instance in=reference to unnamed text, "Visible"=FALSE)
        Property Node(instance in=reference to "Beeper_Cont", "Visible"=FALSE)
        # DIODE VISIBILITY
        Property Node(instance in=reference to "Beeper_Diode", "Visible"=FALSE)
        Property Node(instance in=reference to unnamed text, "Visible"=FALSE)
        # TEMPRTD2W VISIBILITY
        Property Node(instance in=reference to "Auto Zero_TempRTD2w", "Visible"=FALSE)
        # TEMPRTD4W VISIBILITY
        Property Node(instance in=reference to "LowPower_TempRTD4w", "Visible"=FALSE)
        Property Node(instance in=reference to "String_Cont", "Visible"=FALSE)
        Property Node(instance in=reference to "String_Diode", "Visible"=FALSE)
        Property Node(instance in=reference to unnamed text, "Visible"=FALSE)
        # TEMPMAIN VISIBILITY
        Property Node(instance in=reference to "Probe_TempMain", "Visible"=FALSE)
        # TEMPTHERMIS4W VISIBILITY
        Property Node(instance in=reference to "Aperture NPLC_TempThermis4w", "Visible"=FALSE)
        # TEMPTHERMIS2W VISIBILITY
        Property Node(instance in=reference to "Aperture NPLC_TempThermis2w", "Visible"=FALSE)
        Property Node(instance in=reference to "LowPower_TempRTD2w", "Visible"=FALSE)
        Property Node(instance in=reference to "OffstComp_TempRTD4w", "Visible"=FALSE)
        Property Node(instance in=reference to "Aperture Time_TempThermis4w", "Visible"=FALSE)
        Property Node(instance in=reference to "Aperture Time_TempThermis2w", "Visible"=FALSE)
        Property Node(instance in=reference to "OffstComp_TempRTD2w", "Visible"=FALSE)
        Property Node(instance in=reference to "R0_TempRTD4w", "Visible"=FALSE)
        Property Node(instance in=reference to "Aperture_TempThermis4w", "Visible"=FALSE)
        Property Node(instance in=reference to "Aperture_TempThermis2w", "Visible"=FALSE)
        Property Node(instance in=reference to "R0_TempRTD2w", "Visible"=FALSE)
        Property Node(instance in=reference to "Aperture NPLC_TempRTD4w", "Visible"=FALSE)
        Property Node(instance in=reference to "LowPower_TempThermis4w", "Visible"=FALSE)
        Property Node(instance in=reference to "Auto Zero_TempThermis2w", "Visible"=FALSE)
        Event Data() -> ("Old Value"=w14, "New Value"=w15)
        # EVENT NIE DLA
        # CONTROL NEW VALUE F
        # INDICATOR OLD
        Property Node(instance in=reference to "VoltageAC_indicator", "Visible"=w14)
        Property Node(instance in=reference to "Aperture NPLC_TempRTD2w", "Visible"=FALSE)
        Property Node(instance in=reference to "Aperture Time_TempRTD4w", "Visible"=FALSE)
        Property Node(instance in=reference to "Units_TempThermis4w", "Visible"=FALSE)
        Property Node(instance in=reference to "LowPower_TempThermis2w", "Visible"=FALSE)
        Property Node(instance in=reference to "Aperture Time_TempRTD2w", "Visible"=FALSE)
        Property Node(instance in=reference to "Aperture_TempRTD4w", "Visible"=FALSE)
        Property Node(instance in=reference to "CurrentDC_indicator", "Visible"=w14)
        Property Node(instance in=reference to "String_TempThermis4w", "Visible"=FALSE)
        Property Node(instance in=reference to "Units_TempThermis2w", "Visible"=FALSE)
        Property Node(instance in=reference to "Aperture_TempRTD2w", "Visible"=FALSE)
        Property Node(instance in=reference to "Units_TempRTD4w", "Visible"=FALSE)
        Property Node(instance in=reference to "CurrentAC_indicator", "Visible"=w14)
        Property Node(instance in=reference to "String_TempThermis2w", "Visible"=FALSE)
        Property Node(instance in=reference to "Units_TempRTD2w", "Visible"=FALSE)
        Property Node(instance in=reference to "String_TempRTD4w", "Visible"=FALSE)
        Property Node(instance in=reference to "2WResistance_indicator", "Visible"=w14)
        Property Node(instance in=reference to "String_TempRTD2w", "Visible"=FALSE)
        Property Node(instance in=reference to "VoltageDC_indicator", "Visible"=w14)
        Property Node(instance in=reference to "Frequency_indicator", "Visible"=w14)
        Property Node(instance in=reference to "Capacitance_indicator", "Visible"=w14)
        Property Node(instance in=reference to "Continuity_indicator", "Visible"=w14)
        Property Node(instance in=reference to "Diode_indicator", "Visible"=w14)
        Property Node(instance in=reference to "Temperature_indicator", "Visible"=w14)
        # EVENT DLA
        # CONTROL OLD
        # INDICATOR NEW
        Property Node(instance in=reference to "4WResistance_control", "Visible"=w14)
        Property Node(instance in=reference to "4WResistance_indicator", "Visible"=w15)
        Property Node(instance in=reference to "VoltageAC_control", "Visible"=w15, "Value"=FALSE)
        Property Node(instance in=reference to "CurrentDC_control", "Visible"=w15, "Value"=FALSE)
        Property Node(instance in=reference to "CurrentAC_control", "Visible"=w15, "Value"=FALSE)
        Property Node(instance in=reference to "2WResistance_control", "Visible"=w15, "Value"=FALSE)
        Property Node(instance in=reference to "VoltageDC_control", "Visible"=w15, "Value"=FALSE)
        Property Node(instance in=reference to "Frequency_control", "Visible"=w15, "Value"=FALSE)
        Property Node(instance in=reference to "Capacitance_control", "Visible"=w15, "Value"=FALSE)
        Property Node(instance in=reference to "Continuity_control", "Visible"=w15, "Value"=FALSE)
        Property Node(instance in=reference to "Diode_control", "Visible"=w15, "Value"=FALSE)
        Property Node(instance in=reference to "Temperature_control", "Visible"=w15, "Value"=FALSE)
        w1 = default
      }
      on "Frequency_control" Value changed {
        # TITLES VISIBILITY
        Property Node(instance in=reference to unnamed text, "Visible"=FALSE)
        # DCV VISIBILITY
        Property Node(instance in=reference to "DIG Option On/Off_DCV", "Visible"=FALSE)
        # DCC VISIBILITY
        Property Node(instance in=reference to "TerminalType_DCC", "Visible"=FALSE)
        # ACV VISIBILITY
        Property Node(instance in=reference to "Manual Range_ACV", "Visible"=FALSE)
        Property Node(instance in=reference to unnamed text, "Visible"=FALSE)
        # DCVRATIO VISIBILITY
        Property Node(instance in=reference to "DIG Option On/Off_DCVR", "Visible"=FALSE)
        # 4WR VISIBILITY
        Property Node(instance in=reference to "Aperture NPLC_4WR", "Visible"=FALSE)
        # 2WR VISIBILITY
        Property Node(instance in=reference to "Aperture NPLC_2WR", "Visible"=FALSE)
        # FREQ VISIBILITY
        Property Node(instance in=reference to "ACFilter_Freq", "Visible"=TRUE)
        Property Node(instance in=reference to "Auto Impedance_DCV", "Visible"=FALSE)
        # ACC VISIBILITY
        Property Node(instance in=reference to "TerminalType_ACC", "Visible"=FALSE)
        Property Node(instance in=reference to "Auto Range_DCC", "Visible"=FALSE)
        Property Node(instance in=reference to unnamed text, "Visible"=FALSE)
        Property Node(instance in=reference to "Auto Impedance_DCVR", "Visible"=FALSE)
        Property Node(instance in=reference to "VoltageBandwidth_ACV", "Visible"=FALSE)
        # CAPACI VISIBILITY
        Property Node(instance in=reference to "Manual Range_Capaci", "Visible"=FALSE)
        Property Node(instance in=reference to "Aperture Time_4WR", "Visible"=FALSE)
        Property Node(instance in=reference to "Aperture Time_2WR", "Visible"=FALSE)
        Property Node(instance in=reference to "Auto Range_Freq", "Visible"=TRUE)
        Property Node(instance in=reference to "Manual Range_DCV", "Visible"=FALSE, "Disabled"=TRUE)
        Property Node(instance in=reference to "VoltageBandwidth_ACC", "Visible"=FALSE)
        Property Node(instance in=reference to "Manual Range_DCC", "Visible"=FALSE)
        Property Node(instance in=reference to unnamed text, "Visible"=FALSE)
        Property Node(instance in=reference to "Manual Range_DCVR", "Visible"=FALSE)
        Property Node(instance in=reference to "Auto Range_Capaci", "Visible"=FALSE)
        Property Node(instance in=reference to "String_ACV", "Visible"=FALSE)
        Property Node(instance in=reference to "Aperture_4WR", "Visible"=FALSE)
        Property Node(instance in=reference to "Aperture_2WR", "Visible"=FALSE)
        Property Node(instance in=reference to "GateTime_Freq", "Visible"=TRUE)
        Property Node(instance in=reference to "Aperture NPLC_DCV", "Visible"=FALSE)
        Property Node(instance in=reference to "Manual Range_ACC", "Visible"=FALSE)
        Property Node(instance in=reference to "Aperture_DCC", "Visible"=FALSE)
        Property Node(instance in=reference to "Aperture NPLC_DCVR", "Visible"=FALSE)
        Property Node(instance in=reference to "String_Capaci", "Visible"=FALSE)
        Property Node(instance in=reference to "Auto Range_4WR", "Visible"=FALSE)
        Property Node(instance in=reference to unnamed text, "Visible"=FALSE)
        Property Node(instance in=reference to "Auto Range_2WR", "Visible"=FALSE)
        Property Node(instance in=reference to "Auto Range_ACV", "Visible"=FALSE)
        Property Node(instance in=reference to "Manual Range_Freq", "Visible"=TRUE)
        Property Node(instance in=reference to "Aperture_DCV", "Visible"=FALSE)
        Property Node(instance in=reference to "Auto Range_ACC", "Visible"=FALSE)
        Property Node(instance in=reference to "Aperture NPLC_DCC", "Visible"=FALSE)
        Property Node(instance in=reference to "Aperture_DCVR", "Visible"=FALSE)
        Property Node(instance in=reference to "LowPower_4WR", "Visible"=FALSE)
        Property Node(instance in=reference to unnamed text, "Visible"=FALSE)
        Property Node(instance in=reference to "Auto Zero_2WR", "Visible"=FALSE)
        Property Node(instance in=reference to "Timeout_Freq", "Visible"=TRUE)
        Property Node(instance in=reference to "Auto Range_DCV", "Visible"=FALSE)
        Property Node(instance in=reference to "String_ACC", "Visible"=FALSE)
        Property Node(instance in=reference to "Aperture Time_DCC", "Visible"=FALSE)
        Property Node(instance in=reference to "Auto Range_DCVR", "Visible"=FALSE)
        Property Node(instance in=reference to "Manual Range_4WR", "Visible"=FALSE)
        Property Node(instance in=reference to unnamed text, "Visible"=FALSE)
        Property Node(instance in=reference to "LowPower_2WR", "Visible"=FALSE)
        Property Node(instance in=reference to "String_Freq", "Visible"=TRUE)
        Property Node(instance in=reference to "DCV Ratio_toenable", "Visible"=FALSE)
        Property Node(instance in=reference to "Auto Zero_DCC", "Visible"=FALSE)
        Property Node(instance in=reference to "DCV Ratio_todisable", "Visible"=FALSE)
        Property Node(instance in=reference to "OffstComp_4WR", "Visible"=FALSE)
        Property Node(instance in=reference to unnamed text, "Visible"=FALSE)
        Property Node(instance in=reference to "Manual Range_2WR", "Visible"=FALSE)
        Property Node(instance in=reference to "Aperture Time_DCV", "Visible"=FALSE)
        Property Node(instance in=reference to "Aperture Time_DCVR", "Visible"=FALSE)
        Property Node(instance in=reference to "String_4WR", "Visible"=FALSE)
        Property Node(instance in=reference to unnamed text, "Visible"=TRUE)
        Property Node(instance in=reference to "String_DCC", "Visible"=FALSE)
        Property Node(instance in=reference to "OffstComp_2WR", "Visible"=FALSE)
        Property Node(instance in=reference to "String_DCV", "Visible"=FALSE)
        # CONT VISIBILITY
        Property Node(instance in=reference to "String_DCVR", "Visible"=FALSE)
        Property Node(instance in=reference to unnamed text, "Visible"=FALSE)
        Property Node(instance in=reference to "String_2WR", "Visible"=FALSE)
        Property Node(instance in=reference to "Auto Zero_DCV", "Visible"=FALSE)
        Property Node(instance in=reference to unnamed text, "Visible"=FALSE)
        Property Node(instance in=reference to "Beeper_Cont", "Visible"=FALSE)
        # DIODE VISIBILITY
        Property Node(instance in=reference to "Beeper_Diode", "Visible"=FALSE)
        # TEMPRTD2W VISIBILITY
        Property Node(instance in=reference to "Auto Zero_TempRTD2w", "Visible"=FALSE)
        # TEMPRTD4W VISIBILITY
        Property Node(instance in=reference to "LowPower_TempRTD4w", "Visible"=FALSE)
        Property Node(instance in=reference to unnamed text, "Visible"=FALSE)
        # TEMPMAIN VISIBILITY
        Property Node(instance in=reference to "Probe_TempMain", "Visible"=FALSE)
        Property Node(instance in=reference to "String_Cont", "Visible"=FALSE)
        Property Node(instance in=reference to "String_Diode", "Visible"=FALSE)
        # TEMPTHERMIS4W VISIBILITY
        Property Node(instance in=reference to "Aperture NPLC_TempThermis4w", "Visible"=FALSE)
        Property Node(instance in=reference to "LowPower_TempRTD2w", "Visible"=FALSE)
        Property Node(instance in=reference to "OffstComp_TempRTD4w", "Visible"=FALSE)
        # TEMPTHERMIS2W VISIBILITY
        Property Node(instance in=reference to "Aperture NPLC_TempThermis2w", "Visible"=FALSE)
        Property Node(instance in=reference to unnamed text, "Visible"=FALSE)
        Property Node(instance in=reference to "Aperture Time_TempThermis4w", "Visible"=FALSE)
        Property Node(instance in=reference to "OffstComp_TempRTD2w", "Visible"=FALSE)
        Property Node(instance in=reference to "Aperture Time_TempThermis2w", "Visible"=FALSE)
        Property Node(instance in=reference to "R0_TempRTD4w", "Visible"=FALSE)
        Property Node(instance in=reference to "Aperture_TempThermis4w", "Visible"=FALSE)
        Property Node(instance in=reference to "Aperture_TempThermis2w", "Visible"=FALSE)
        Property Node(instance in=reference to "R0_TempRTD2w", "Visible"=FALSE)
        Property Node(instance in=reference to "Aperture NPLC_TempRTD4w", "Visible"=FALSE)
        Property Node(instance in=reference to "LowPower_TempThermis4w", "Visible"=FALSE)
        Property Node(instance in=reference to "Auto Zero_TempThermis2w", "Visible"=FALSE)
        Property Node(instance in=reference to "Aperture NPLC_TempRTD2w", "Visible"=FALSE)
        Property Node(instance in=reference to "Aperture Time_TempRTD4w", "Visible"=FALSE)
        Event Data() -> ("Old Value"=w16, "New Value"=w17)
        # EVENT NIE DLA
        # CONTROL NEW VALUE F
        # INDICATOR OLD
        Property Node(instance in=reference to "VoltageAC_indicator", "Visible"=w16)
        Property Node(instance in=reference to "Units_TempThermis4w", "Visible"=FALSE)
        Property Node(instance in=reference to "LowPower_TempThermis2w", "Visible"=FALSE)
        Property Node(instance in=reference to "Aperture Time_TempRTD2w", "Visible"=FALSE)
        Property Node(instance in=reference to "Aperture_TempRTD4w", "Visible"=FALSE)
        Property Node(instance in=reference to "String_TempThermis4w", "Visible"=FALSE)
        Property Node(instance in=reference to "Units_TempThermis2w", "Visible"=FALSE)
        Property Node(instance in=reference to "Aperture_TempRTD2w", "Visible"=FALSE)
        Property Node(instance in=reference to "CurrentDC_indicator", "Visible"=w16)
        Property Node(instance in=reference to "Units_TempRTD4w", "Visible"=FALSE)
        Property Node(instance in=reference to "String_TempThermis2w", "Visible"=FALSE)
        Property Node(instance in=reference to "Units_TempRTD2w", "Visible"=FALSE)
        Property Node(instance in=reference to "String_TempRTD4w", "Visible"=FALSE)
        Property Node(instance in=reference to "CurrentAC_indicator", "Visible"=w16)
        Property Node(instance in=reference to "String_TempRTD2w", "Visible"=FALSE)
        Property Node(instance in=reference to "2WResistance_indicator", "Visible"=w16)
        Property Node(instance in=reference to "4WResistance_indicator", "Visible"=w16)
        Property Node(instance in=reference to "VoltageDC_indicator", "Visible"=w16)
        Property Node(instance in=reference to "Capacitance_indicator", "Visible"=w16)
        Property Node(instance in=reference to "Continuity_indicator", "Visible"=w16)
        Property Node(instance in=reference to "Diode_indicator", "Visible"=w16)
        Property Node(instance in=reference to "Temperature_indicator", "Visible"=w16)
        # EVENT DLA
        # CONTROL OLD
        # INDICATOR NEW
        Property Node(instance in=reference to "Frequency_control", "Visible"=w16)
        Property Node(instance in=reference to "Frequency_indicator", "Visible"=w17)
        Property Node(instance in=reference to "VoltageAC_control", "Visible"=w17, "Value"=FALSE)
        Property Node(instance in=reference to "CurrentDC_control", "Visible"=w17, "Value"=FALSE)
        Property Node(instance in=reference to "CurrentAC_control", "Visible"=w17, "Value"=FALSE)
        Property Node(instance in=reference to "2WResistance_control", "Visible"=w17, "Value"=FALSE)
        Property Node(instance in=reference to "4WResistance_control", "Visible"=w17, "Value"=FALSE)
        Property Node(instance in=reference to "VoltageDC_control", "Visible"=w17, "Value"=FALSE)
        Property Node(instance in=reference to "Capacitance_control", "Visible"=w17, "Value"=FALSE)
        Property Node(instance in=reference to "Continuity_control", "Visible"=w17, "Value"=FALSE)
        Property Node(instance in=reference to "Diode_control", "Visible"=w17, "Value"=FALSE)
        Property Node(instance in=reference to "Temperature_control", "Visible"=w17, "Value"=FALSE)
        w1 = default
      }
      on "Capacitance_control" Value changed {
        # TITLES VISIBILITY
        Property Node(instance in=reference to unnamed text, "Visible"=FALSE)
        # DCV VISIBILITY
        Property Node(instance in=reference to "DIG Option On/Off_DCV", "Visible"=FALSE)
        # DCC VISIBILITY
        Property Node(instance in=reference to "TerminalType_DCC", "Visible"=FALSE)
        # ACV VISIBILITY
        Property Node(instance in=reference to "Manual Range_ACV", "Visible"=FALSE)
        Property Node(instance in=reference to unnamed text, "Visible"=FALSE)
        # DCVRATIO VISIBILITY
        Property Node(instance in=reference to "DIG Option On/Off_DCVR", "Visible"=FALSE)
        # 4WR VISIBILITY
        Property Node(instance in=reference to "Aperture NPLC_4WR", "Visible"=FALSE)
        # 2WR VISIBILITY
        Property Node(instance in=reference to "Aperture NPLC_2WR", "Visible"=FALSE)
        Property Node(instance in=reference to "Auto Impedance_DCV", "Visible"=FALSE)
        # ACC VISIBILITY
        Property Node(instance in=reference to "TerminalType_ACC", "Visible"=FALSE)
        Property Node(instance in=reference to "Auto Range_DCC", "Visible"=FALSE)
        Property Node(instance in=reference to unnamed text, "Visible"=FALSE)
        Property Node(instance in=reference to "Auto Impedance_DCVR", "Visible"=FALSE)
        # CAPACI VISIBILITY
        Property Node(instance in=reference to "Manual Range_Capaci", "Visible"=TRUE)
        Property Node(instance in=reference to "VoltageBandwidth_ACV", "Visible"=FALSE)
        # FREQ VISIBILITY
        Property Node(instance in=reference to "ACFilter_Freq", "Visible"=FALSE)
        Property Node(instance in=reference to "Aperture Time_4WR", "Visible"=FALSE)
        Property Node(instance in=reference to "Aperture Time_2WR", "Visible"=FALSE)
        Property Node(instance in=reference to "Manual Range_DCV", "Visible"=FALSE, "Disabled"=TRUE)
        Property Node(instance in=reference to "VoltageBandwidth_ACC", "Visible"=FALSE)
        Property Node(instance in=reference to "Manual Range_DCC", "Visible"=FALSE)
        Property Node(instance in=reference to unnamed text, "Visible"=FALSE)
        Property Node(instance in=reference to "Manual Range_DCVR", "Visible"=FALSE)
        Property Node(instance in=reference to "Auto Range_Capaci", "Visible"=TRUE)
        Property Node(instance in=reference to "String_ACV", "Visible"=FALSE)
        Property Node(instance in=reference to "Auto Range_Freq", "Visible"=FALSE)
        Property Node(instance in=reference to "Aperture_4WR", "Visible"=FALSE)
        Property Node(instance in=reference to "Aperture_2WR", "Visible"=FALSE)
        Property Node(instance in=reference to "Aperture NPLC_DCV", "Visible"=FALSE)
        Property Node(instance in=reference to "Manual Range_ACC", "Visible"=FALSE)
        Property Node(instance in=reference to "Aperture_DCC", "Visible"=FALSE)
        Property Node(instance in=reference to "Aperture NPLC_DCVR", "Visible"=FALSE)
        Property Node(instance in=reference to "String_Capaci", "Visible"=TRUE)
        Property Node(instance in=reference to "GateTime_Freq", "Visible"=FALSE)
        Property Node(instance in=reference to unnamed text, "Visible"=FALSE)
        Property Node(instance in=reference to "Auto Range_ACV", "Visible"=FALSE)
        Property Node(instance in=reference to "Auto Range_4WR", "Visible"=FALSE)
        Property Node(instance in=reference to "Auto Range_2WR", "Visible"=FALSE)
        Property Node(instance in=reference to "Aperture_DCV", "Visible"=FALSE)
        Property Node(instance in=reference to "Auto Range_ACC", "Visible"=FALSE)
        Property Node(instance in=reference to "Aperture NPLC_DCC", "Visible"=FALSE)
        Property Node(instance in=reference to "Aperture_DCVR", "Visible"=FALSE)
        Property Node(instance in=reference to "Manual Range_Freq", "Visible"=FALSE)
        Property Node(instance in=reference to unnamed text, "Visible"=FALSE)
        Property Node(instance in=reference to "LowPower_4WR", "Visible"=FALSE)
        Property Node(instance in=reference to "Auto Zero_2WR", "Visible"=FALSE)
        Property Node(instance in=reference to "Auto Range_DCV", "Visible"=FALSE)
        Property Node(instance in=reference to "String_ACC", "Visible"=FALSE)
        Property Node(instance in=reference to "Aperture Time_DCC", "Visible"=FALSE)
        Property Node(instance in=reference to "Auto Range_DCVR", "Visible"=FALSE)
        Property Node(instance in=reference to "Timeout_Freq", "Visible"=FALSE)
        Property Node(instance in=reference to unnamed text, "Visible"=FALSE)
        Property Node(instance in=reference to "Manual Range_4WR", "Visible"=FALSE)
        Property Node(instance in=reference to "LowPower_2WR", "Visible"=FALSE)
        Property Node(instance in=reference to "DCV Ratio_toenable", "Visible"=FALSE)
        Property Node(instance in=reference to "Auto Zero_DCC", "Visible"=FALSE)
        Property Node(instance in=reference to "DCV Ratio_todisable", "Visible"=FALSE)
        Property Node(instance in=reference to "String_Freq", "Visible"=FALSE)
        Property Node(instance in=reference to unnamed text, "Visible"=FALSE)
        Property Node(instance in=reference to "OffstComp_4WR", "Visible"=FALSE)
        Property Node(instance in=reference to "Manual Range_2WR", "Visible"=FALSE)
        Property Node(instance in=reference to "Aperture Time_DCV", "Visible"=FALSE)
        Property Node(instance in=reference to "Aperture Time_DCVR", "Visible"=FALSE)
        Property Node(instance in=reference to unnamed text, "Visible"=FALSE)
        Property Node(instance in=reference to "String_DCC", "Visible"=FALSE)
        Property Node(instance in=reference to "String_4WR", "Visible"=FALSE)
        Property Node(instance in=reference to "OffstComp_2WR", "Visible"=FALSE)
        Property Node(instance in=reference to "String_DCV", "Visible"=FALSE)
        Property Node(instance in=reference to "String_DCVR", "Visible"=FALSE)
        Property Node(instance in=reference to unnamed text, "Visible"=TRUE)
        Property Node(instance in=reference to "String_2WR", "Visible"=FALSE)
        Property Node(instance in=reference to "Auto Zero_DCV", "Visible"=FALSE)
        Property Node(instance in=reference to unnamed text, "Visible"=FALSE)
        # CONT VISIBILITY
        Property Node(instance in=reference to "Beeper_Cont", "Visible"=FALSE)
        # DIODE VISIBILITY
        Property Node(instance in=reference to "Beeper_Diode", "Visible"=FALSE)
        Property Node(instance in=reference to unnamed text, "Visible"=FALSE)
        # TEMPRTD2W VISIBILITY
        Property Node(instance in=reference to "Auto Zero_TempRTD2w", "Visible"=FALSE)
        # TEMPRTD4W VISIBILITY
        Property Node(instance in=reference to "LowPower_TempRTD4w", "Visible"=FALSE)
        Property Node(instance in=reference to "String_Cont", "Visible"=FALSE)
        Property Node(instance in=reference to "String_Diode", "Visible"=FALSE)
        # TEMPMAIN VISIBILITY
        Property Node(instance in=reference to "Probe_TempMain", "Visible"=FALSE)
        # TEMPTHERMIS4W VISIBILITY
        Property Node(instance in=reference to "Aperture NPLC_TempThermis4w", "Visible"=FALSE)
        Property Node(instance in=reference to unnamed text, "Visible"=FALSE)
        # TEMPTHERMIS2W VISIBILITY
        Property Node(instance in=reference to "Aperture NPLC_TempThermis2w", "Visible"=FALSE)
        Property Node(instance in=reference to "LowPower_TempRTD2w", "Visible"=FALSE)
        Property Node(instance in=reference to "OffstComp_TempRTD4w", "Visible"=FALSE)
        Property Node(instance in=reference to "Aperture Time_TempThermis4w", "Visible"=FALSE)
        Property Node(instance in=reference to "Aperture Time_TempThermis2w", "Visible"=FALSE)
        Property Node(instance in=reference to "OffstComp_TempRTD2w", "Visible"=FALSE)
        Property Node(instance in=reference to "R0_TempRTD4w", "Visible"=FALSE)
        Property Node(instance in=reference to "Aperture_TempThermis4w", "Visible"=FALSE)
        Property Node(instance in=reference to "Aperture_TempThermis2w", "Visible"=FALSE)
        Property Node(instance in=reference to "R0_TempRTD2w", "Visible"=FALSE)
        Property Node(instance in=reference to "Aperture NPLC_TempRTD4w", "Visible"=FALSE)
        Property Node(instance in=reference to "LowPower_TempThermis4w", "Visible"=FALSE)
        Property Node(instance in=reference to "Auto Zero_TempThermis2w", "Visible"=FALSE)
        Property Node(instance in=reference to "Aperture NPLC_TempRTD2w", "Visible"=FALSE)
        Property Node(instance in=reference to "Aperture Time_TempRTD4w", "Visible"=FALSE)
        Event Data() -> ("Old Value"=w18, "New Value"=w19)
        # EVENT NIE DLA
        # CONTROL NEW VALUE F
        # INDICATOR OLD
        Property Node(instance in=reference to "VoltageAC_indicator", "Visible"=w18)
        Property Node(instance in=reference to "Units_TempThermis4w", "Visible"=FALSE)
        Property Node(instance in=reference to "LowPower_TempThermis2w", "Visible"=FALSE)
        Property Node(instance in=reference to "Aperture Time_TempRTD2w", "Visible"=FALSE)
        Property Node(instance in=reference to "Aperture_TempRTD4w", "Visible"=FALSE)
        Property Node(instance in=reference to "CurrentDC_indicator", "Visible"=w18)
        Property Node(instance in=reference to "String_TempThermis4w", "Visible"=FALSE)
        Property Node(instance in=reference to "Units_TempThermis2w", "Visible"=FALSE)
        Property Node(instance in=reference to "Aperture_TempRTD2w", "Visible"=FALSE)
        Property Node(instance in=reference to "Units_TempRTD4w", "Visible"=FALSE)
        Property Node(instance in=reference to "String_TempThermis2w", "Visible"=FALSE)
        Property Node(instance in=reference to "CurrentAC_indicator", "Visible"=w18)
        Property Node(instance in=reference to "Units_TempRTD2w", "Visible"=FALSE)
        Property Node(instance in=reference to "String_TempRTD4w", "Visible"=FALSE)
        Property Node(instance in=reference to "2WResistance_indicator", "Visible"=w18)
        Property Node(instance in=reference to "String_TempRTD2w", "Visible"=FALSE)
        Property Node(instance in=reference to "4WResistance_indicator", "Visible"=w18)
        Property Node(instance in=reference to "Frequency_indicator", "Visible"=w18)
        Property Node(instance in=reference to "VoltageDC_indicator", "Visible"=w18)
        Property Node(instance in=reference to "Continuity_indicator", "Visible"=w18)
        Property Node(instance in=reference to "Diode_indicator", "Visible"=w18)
        Property Node(instance in=reference to "Temperature_indicator", "Visible"=w18)
        # EVENT DLA
        # CONTROL OLD
        # INDICATOR NEW
        Property Node(instance in=reference to "Capacitance_control", "Visible"=w18)
        Property Node(instance in=reference to "Capacitance_indicator", "Visible"=w19)
        Property Node(instance in=reference to "VoltageAC_control", "Visible"=w19, "Value"=FALSE)
        Property Node(instance in=reference to "CurrentDC_control", "Visible"=w19, "Value"=FALSE)
        Property Node(instance in=reference to "CurrentAC_control", "Visible"=w19, "Value"=FALSE)
        Property Node(instance in=reference to "2WResistance_control", "Visible"=w19, "Value"=FALSE)
        Property Node(instance in=reference to "4WResistance_control", "Visible"=w19, "Value"=FALSE)
        Property Node(instance in=reference to "Frequency_control", "Visible"=w19, "Value"=FALSE)
        Property Node(instance in=reference to "VoltageDC_control", "Visible"=w19, "Value"=FALSE)
        Property Node(instance in=reference to "Continuity_control", "Visible"=w19, "Value"=FALSE)
        Property Node(instance in=reference to "Diode_control", "Visible"=w19, "Value"=FALSE)
        Property Node(instance in=reference to "Temperature_control", "Visible"=w19, "Value"=FALSE)
        w1 = default
      }
      on "Continuity_control" Value changed {
        # TITLES VISIBILITY
        Property Node(instance in=reference to unnamed text, "Visible"=FALSE)
        # DCV VISIBILITY
        Property Node(instance in=reference to "DIG Option On/Off_DCV", "Visible"=FALSE)
        # DCC VISIBILITY
        Property Node(instance in=reference to "TerminalType_DCC", "Visible"=FALSE)
        # ACV VISIBILITY
        Property Node(instance in=reference to "Manual Range_ACV", "Visible"=FALSE)
        Property Node(instance in=reference to unnamed text, "Visible"=FALSE)
        # DCVRATIO VISIBILITY
        Property Node(instance in=reference to "DIG Option On/Off_DCVR", "Visible"=FALSE)
        Property Node(instance in=reference to "Auto Impedance_DCV", "Visible"=FALSE)
        # ACC VISIBILITY
        Property Node(instance in=reference to "TerminalType_ACC", "Visible"=FALSE)
        Property Node(instance in=reference to "Auto Range_DCC", "Visible"=FALSE)
        # 2WR VISIBILITY
        # TEMPRTD2W VISIBILITY
        Property Node(instance in=reference to "Aperture NPLC_2WR", "Visible"=FALSE)
        # 4WR VISIBILITY
        Property Node(instance in=reference to "Aperture NPLC_4WR", "Visible"=FALSE)
        Property Node(instance in=reference to unnamed text, "Visible"=FALSE)
        Property Node(instance in=reference to "Auto Impedance_DCVR", "Visible"=FALSE)
        Property Node(instance in=reference to "VoltageBandwidth_ACV", "Visible"=FALSE)
        # FREQ VISIBILITY
        Property Node(instance in=reference to "ACFilter_Freq", "Visible"=FALSE)
        # CAPACI VISIBILITY
        Property Node(instance in=reference to "Manual Range_Capaci", "Visible"=FALSE)
        Property Node(instance in=reference to "Manual Range_DCV", "Visible"=FALSE, "Disabled"=TRUE)
        Property Node(instance in=reference to "VoltageBandwidth_ACC", "Visible"=FALSE)
        Property Node(instance in=reference to "Manual Range_DCC", "Visible"=FALSE)
        Property Node(instance in=reference to "Aperture Time_2WR", "Visible"=FALSE)
        Property Node(instance in=reference to "Aperture Time_4WR", "Visible"=FALSE)
        Property Node(instance in=reference to unnamed text, "Visible"=FALSE)
        Property Node(instance in=reference to "Manual Range_DCVR", "Visible"=FALSE)
        Property Node(instance in=reference to "String_ACV", "Visible"=FALSE)
        Property Node(instance in=reference to "Auto Range_Freq", "Visible"=FALSE)
        Property Node(instance in=reference to "Auto Range_Capaci", "Visible"=FALSE)
        Property Node(instance in=reference to "Aperture NPLC_DCV", "Visible"=FALSE)
        Property Node(instance in=reference to "Manual Range_ACC", "Visible"=FALSE)
        Property Node(instance in=reference to "Aperture_DCC", "Visible"=FALSE)
        Property Node(instance in=reference to "Aperture_2WR", "Visible"=FALSE)
        Property Node(instance in=reference to "Aperture_4WR", "Visible"=FALSE)
        Property Node(instance in=reference to "Aperture NPLC_DCVR", "Visible"=FALSE)
        Property Node(instance in=reference to unnamed text, "Visible"=FALSE)
        Property Node(instance in=reference to "GateTime_Freq", "Visible"=FALSE)
        Property Node(instance in=reference to "Auto Range_ACV", "Visible"=FALSE)
        Property Node(instance in=reference to "String_Capaci", "Visible"=FALSE)
        Property Node(instance in=reference to "Aperture_DCV", "Visible"=FALSE)
        Property Node(instance in=reference to "Auto Range_ACC", "Visible"=FALSE)
        Property Node(instance in=reference to "Aperture NPLC_DCC", "Visible"=FALSE)
        Property Node(instance in=reference to "Auto Range_2WR", "Visible"=FALSE)
        Property Node(instance in=reference to "Auto Range_4WR", "Visible"=FALSE)
        Property Node(instance in=reference to "Aperture_DCVR", "Visible"=FALSE)
        Property Node(instance in=reference to unnamed text, "Visible"=FALSE)
        Property Node(instance in=reference to "Manual Range_Freq", "Visible"=FALSE)
        Property Node(instance in=reference to "Auto Range_DCV", "Visible"=FALSE)
        Property Node(instance in=reference to "String_ACC", "Visible"=FALSE)
        Property Node(instance in=reference to "Aperture Time_DCC", "Visible"=FALSE)
        Property Node(instance in=reference to "Auto Zero_2WR", "Visible"=FALSE)
        Property Node(instance in=reference to "LowPower_4WR", "Visible"=FALSE)
        Property Node(instance in=reference to "Auto Range_DCVR", "Visible"=FALSE)
        Property Node(instance in=reference to unnamed text, "Visible"=FALSE)
        Property Node(instance in=reference to "Timeout_Freq", "Visible"=FALSE)
        Property Node(instance in=reference to "DCV Ratio_toenable", "Visible"=FALSE)
        Property Node(instance in=reference to "Auto Zero_DCC", "Visible"=FALSE)
        Property Node(instance in=reference to "LowPower_2WR", "Visible"=FALSE)
        Property Node(instance in=reference to "Manual Range_4WR", "Visible"=FALSE)
        Property Node(instance in=reference to "DCV Ratio_todisable", "Visible"=FALSE)
        Property Node(instance in=reference to unnamed text, "Visible"=FALSE)
        Property Node(instance in=reference to "String_Freq", "Visible"=FALSE)
        Property Node(instance in=reference to "Aperture Time_DCV", "Visible"=FALSE)
        Property Node(instance in=reference to "Manual Range_2WR", "Visible"=FALSE)
        Property Node(instance in=reference to "OffstComp_4WR", "Visible"=FALSE)
        Property Node(instance in=reference to "Aperture Time_DCVR", "Visible"=FALSE)
        Property Node(instance in=reference to unnamed text, "Visible"=FALSE)
        Property Node(instance in=reference to "String_DCC", "Visible"=FALSE)
        Property Node(instance in=reference to "String_DCV", "Visible"=FALSE)
        Property Node(instance in=reference to "OffstComp_2WR", "Visible"=FALSE)
        Property Node(instance in=reference to "String_4WR", "Visible"=FALSE)
        # CONT VISIBILITY
        Property Node(instance in=reference to "String_DCVR", "Visible"=FALSE)
        Property Node(instance in=reference to unnamed text, "Visible"=FALSE)
        Property Node(instance in=reference to "Auto Zero_DCV", "Visible"=FALSE)
        Property Node(instance in=reference to "String_2WR", "Visible"=FALSE)
        Property Node(instance in=reference to unnamed text, "Visible"=TRUE)
        Property Node(instance in=reference to "Beeper_Cont", "Visible"=TRUE)
        # DIODE VISIBILITY
        Property Node(instance in=reference to "Beeper_Diode", "Visible"=FALSE)
        Property Node(instance in=reference to unnamed text, "Visible"=FALSE)
        Property Node(instance in=reference to "String_Cont", "Visible"=TRUE)
        Property Node(instance in=reference to "Auto Zero_TempRTD2w", "Visible"=FALSE)
        Property Node(instance in=reference to "String_Diode", "Visible"=FALSE)
        # TEMPRTD4W VISIBILITY
        Property Node(instance in=reference to "LowPower_TempRTD4w", "Visible"=FALSE)
        Property Node(instance in=reference to unnamed text, "Visible"=FALSE)
        # TEMPMAIN VISIBILITY
        Property Node(instance in=reference to "Probe_TempMain", "Visible"=FALSE)
        # TEMPTHERMIS4W VISIBILITY
        Property Node(instance in=reference to "Aperture NPLC_TempThermis4w", "Visible"=FALSE)
        # TEMPTHERMIS2W VISIBILITY
        Property Node(instance in=reference to "Aperture NPLC_TempThermis2w", "Visible"=FALSE)
        Property Node(instance in=reference to "LowPower_TempRTD2w", "Visible"=FALSE)
        Property Node(instance in=reference to "OffstComp_TempRTD4w", "Visible"=FALSE)
        Property Node(instance in=reference to "Aperture Time_TempThermis4w", "Visible"=FALSE)
        Property Node(instance in=reference to "Aperture Time_TempThermis2w", "Visible"=FALSE)
        Property Node(instance in=reference to "OffstComp_TempRTD2w", "Visible"=FALSE)
        Property Node(instance in=reference to "R0_TempRTD4w", "Visible"=FALSE)
        Property Node(instance in=reference to "Aperture_TempThermis4w", "Visible"=FALSE)
        Property Node(instance in=reference to "Aperture_TempThermis2w", "Visible"=FALSE)
        Property Node(instance in=reference to "R0_TempRTD2w", "Visible"=FALSE)
        Property Node(instance in=reference to "Aperture NPLC_TempRTD4w", "Visible"=FALSE)
        Property Node(instance in=reference to "LowPower_TempThermis4w", "Visible"=FALSE)
        Property Node(instance in=reference to "Auto Zero_TempThermis2w", "Visible"=FALSE)
        Event Data() -> ("Old Value"=w20, "New Value"=w21)
        # EVENT NIE DLA
        # CONTROL NEW VALUE F
        # INDICATOR OLD
        Property Node(instance in=reference to "VoltageAC_indicator", "Visible"=w20)
        Property Node(instance in=reference to "Aperture NPLC_TempRTD2w", "Visible"=FALSE)
        Property Node(instance in=reference to "Aperture Time_TempRTD4w", "Visible"=FALSE)
        Property Node(instance in=reference to "Units_TempThermis4w", "Visible"=FALSE)
        Property Node(instance in=reference to "LowPower_TempThermis2w", "Visible"=FALSE)
        Property Node(instance in=reference to "Aperture Time_TempRTD2w", "Visible"=FALSE)
        Property Node(instance in=reference to "Aperture_TempRTD4w", "Visible"=FALSE)
        Property Node(instance in=reference to "CurrentDC_indicator", "Visible"=w20)
        Property Node(instance in=reference to "String_TempThermis4w", "Visible"=FALSE)
        Property Node(instance in=reference to "Units_TempThermis2w", "Visible"=FALSE)
        Property Node(instance in=reference to "Aperture_TempRTD2w", "Visible"=FALSE)
        Property Node(instance in=reference to "Units_TempRTD4w", "Visible"=FALSE)
        Property Node(instance in=reference to "CurrentAC_indicator", "Visible"=w20)
        Property Node(instance in=reference to "String_TempThermis2w", "Visible"=FALSE)
        Property Node(instance in=reference to "Units_TempRTD2w", "Visible"=FALSE)
        Property Node(instance in=reference to "String_TempRTD4w", "Visible"=FALSE)
        Property Node(instance in=reference to "2WResistance_indicator", "Visible"=w20)
        Property Node(instance in=reference to "String_TempRTD2w", "Visible"=FALSE)
        Property Node(instance in=reference to "4WResistance_indicator", "Visible"=w20)
        Property Node(instance in=reference to "Frequency_indicator", "Visible"=w20)
        Property Node(instance in=reference to "Capacitance_indicator", "Visible"=w20)
        Property Node(instance in=reference to "VoltageDC_indicator", "Visible"=w20)
        Property Node(instance in=reference to "Diode_indicator", "Visible"=w20)
        Property Node(instance in=reference to "Temperature_indicator", "Visible"=w20)
        # EVENT DLA
        # CONTROL OLD
        # INDICATOR NEW
        Property Node(instance in=reference to "Continuity_control", "Visible"=w20)
        Property Node(instance in=reference to "Continuity_indicator", "Visible"=w21)
        Property Node(instance in=reference to "VoltageAC_control", "Visible"=w21, "Value"=FALSE)
        Property Node(instance in=reference to "CurrentDC_control", "Visible"=w21, "Value"=FALSE)
        Property Node(instance in=reference to "CurrentAC_control", "Visible"=w21, "Value"=FALSE)
        Property Node(instance in=reference to "2WResistance_control", "Visible"=w21, "Value"=FALSE)
        Property Node(instance in=reference to "4WResistance_control", "Visible"=w21, "Value"=FALSE)
        Property Node(instance in=reference to "Frequency_control", "Visible"=w21, "Value"=FALSE)
        Property Node(instance in=reference to "Capacitance_control", "Visible"=w21, "Value"=FALSE)
        Property Node(instance in=reference to "VoltageDC_control", "Visible"=w21, "Value"=FALSE)
        Property Node(instance in=reference to "Diode_control", "Visible"=w21, "Value"=FALSE)
        Property Node(instance in=reference to "Temperature_control", "Visible"=w21, "Value"=FALSE)
        w1 = default
      }
      on "Diode_control" Value changed {
        # TITLES VISIBILITY
        Property Node(instance in=reference to unnamed text, "Visible"=FALSE)
        # DCV VISIBILITY
        Property Node(instance in=reference to "DIG Option On/Off_DCV", "Visible"=FALSE)
        # DCC VISIBILITY
        Property Node(instance in=reference to "TerminalType_DCC", "Visible"=FALSE)
        # ACV VISIBILITY
        Property Node(instance in=reference to "Manual Range_ACV", "Visible"=FALSE)
        Property Node(instance in=reference to unnamed text, "Visible"=FALSE)
        # DCVRATIO VISIBILITY
        Property Node(instance in=reference to "DIG Option On/Off_DCVR", "Visible"=FALSE)
        Property Node(instance in=reference to "Auto Impedance_DCV", "Visible"=FALSE)
        # ACC VISIBILITY
        Property Node(instance in=reference to "TerminalType_ACC", "Visible"=FALSE)
        Property Node(instance in=reference to "Auto Range_DCC", "Visible"=FALSE)
        # 2WR VISIBILITY
        Property Node(instance in=reference to "Aperture NPLC_2WR", "Visible"=FALSE)
        # 4WR VISIBILITY
        Property Node(instance in=reference to "Aperture NPLC_4WR", "Visible"=FALSE)
        Property Node(instance in=reference to unnamed text, "Visible"=FALSE)
        Property Node(instance in=reference to "Auto Impedance_DCVR", "Visible"=FALSE)
        # FREQ VISIBILITY
        Property Node(instance in=reference to "ACFilter_Freq", "Visible"=FALSE)
        Property Node(instance in=reference to "VoltageBandwidth_ACV", "Visible"=FALSE)
        Property Node(instance in=reference to "Manual Range_DCV", "Visible"=FALSE, "Disabled"=TRUE)
        Property Node(instance in=reference to "VoltageBandwidth_ACC", "Visible"=FALSE)
        # CAPACI VISIBILITY
        Property Node(instance in=reference to "Manual Range_Capaci", "Visible"=FALSE)
        Property Node(instance in=reference to "Manual Range_DCC", "Visible"=FALSE)
        Property Node(instance in=reference to "Aperture Time_2WR", "Visible"=FALSE)
        Property Node(instance in=reference to "Aperture Time_4WR", "Visible"=FALSE)
        Property Node(instance in=reference to unnamed text, "Visible"=FALSE)
        Property Node(instance in=reference to "Manual Range_DCVR", "Visible"=FALSE)
        Property Node(instance in=reference to "Auto Range_Freq", "Visible"=FALSE)
        Property Node(instance in=reference to "String_ACV", "Visible"=FALSE)
        Property Node(instance in=reference to "Aperture NPLC_DCV", "Visible"=FALSE)
        Property Node(instance in=reference to "Manual Range_ACC", "Visible"=FALSE)
        Property Node(instance in=reference to "Auto Range_Capaci", "Visible"=FALSE)
        Property Node(instance in=reference to "Aperture_DCC", "Visible"=FALSE)
        Property Node(instance in=reference to "Aperture_2WR", "Visible"=FALSE)
        Property Node(instance in=reference to "Aperture_4WR", "Visible"=FALSE)
        Property Node(instance in=reference to "Aperture NPLC_DCVR", "Visible"=FALSE)
        Property Node(instance in=reference to "GateTime_Freq", "Visible"=FALSE)
        Property Node(instance in=reference to unnamed text, "Visible"=FALSE)
        Property Node(instance in=reference to "Auto Range_ACV", "Visible"=FALSE)
        Property Node(instance in=reference to "Aperture_DCV", "Visible"=FALSE)
        Property Node(instance in=reference to "Auto Range_ACC", "Visible"=FALSE)
        Property Node(instance in=reference to "String_Capaci", "Visible"=FALSE)
        Property Node(instance in=reference to "Aperture NPLC_DCC", "Visible"=FALSE)
        Property Node(instance in=reference to "Auto Range_2WR", "Visible"=FALSE)
        Property Node(instance in=reference to "Auto Range_4WR", "Visible"=FALSE)
        Property Node(instance in=reference to "Aperture_DCVR", "Visible"=FALSE)
        Property Node(instance in=reference to "Manual Range_Freq", "Visible"=FALSE)
        Property Node(instance in=reference to unnamed text, "Visible"=FALSE)
        Property Node(instance in=reference to "Auto Range_DCV", "Visible"=FALSE)
        Property Node(instance in=reference to "String_ACC", "Visible"=FALSE)
        Property Node(instance in=reference to "Aperture Time_DCC", "Visible"=FALSE)
        Property Node(instance in=reference to "Auto Zero_2WR", "Visible"=FALSE)
        Property Node(instance in=reference to "LowPower_4WR", "Visible"=FALSE)
        Property Node(instance in=reference to "Auto Range_DCVR", "Visible"=FALSE)
        Property Node(instance in=reference to "Timeout_Freq", "Visible"=FALSE)
        Property Node(instance in=reference to unnamed text, "Visible"=FALSE)
        Property Node(instance in=reference to "DCV Ratio_toenable", "Visible"=FALSE)
        Property Node(instance in=reference to "Auto Zero_DCC", "Visible"=FALSE)
        Property Node(instance in=reference to "LowPower_2WR", "Visible"=FALSE)
        Property Node(instance in=reference to "Manual Range_4WR", "Visible"=FALSE)
        Property Node(instance in=reference to "DCV Ratio_todisable", "Visible"=FALSE)
        Property Node(instance in=reference to "String_Freq", "Visible"=FALSE)
        Property Node(instance in=reference to unnamed text, "Visible"=FALSE)
        Property Node(instance in=reference to "Aperture Time_DCV", "Visible"=FALSE)
        Property Node(instance in=reference to "Manual Range_2WR", "Visible"=FALSE)
        Property Node(instance in=reference to "OffstComp_4WR", "Visible"=FALSE)
        Property Node(instance in=reference to "Aperture Time_DCVR", "Visible"=FALSE)
        Property Node(instance in=reference to unnamed text, "Visible"=FALSE)
        Property Node(instance in=reference to "String_DCC", "Visible"=FALSE)
        Property Node(instance in=reference to "String_DCV", "Visible"=FALSE)
        Property Node(instance in=reference to "OffstComp_2WR", "Visible"=FALSE)
        Property Node(instance in=reference to "String_4WR", "Visible"=FALSE)
        # CONT VISIBILITY
        Property Node(instance in=reference to "String_DCVR", "Visible"=FALSE)
        Property Node(instance in=reference to unnamed text, "Visible"=FALSE)
        Property Node(instance in=reference to "Auto Zero_DCV", "Visible"=FALSE)
        Property Node(instance in=reference to "String_2WR", "Visible"=FALSE)
        Property Node(instance in=reference to unnamed text, "Visible"=FALSE)
        Property Node(instance in=reference to "Beeper_Cont", "Visible"=FALSE)
        # DIODE VISIBILITY
        Property Node(instance in=reference to "Beeper_Diode", "Visible"=TRUE)
        Property Node(instance in=reference to unnamed text, "Visible"=TRUE)
        Property Node(instance in=reference to "String_Cont", "Visible"=FALSE)
        Property Node(instance in=reference to "String_Diode", "Visible"=TRUE)
        Property Node(instance in=reference to unnamed text, "Visible"=FALSE)
        # TEMPRTD2W VISIBILITY
        Property Node(instance in=reference to "Auto Zero_TempRTD2w", "Visible"=FALSE)
        # TEMPRTD4W VISIBILITY
        Property Node(instance in=reference to "LowPower_TempRTD4w", "Visible"=FALSE)
        # TEMPTHERMIS4W VISIBILITY
        Property Node(instance in=reference to "Aperture NPLC_TempThermis4w", "Visible"=FALSE)
        # TEMPTHERMIS2W VISIBILITY
        Property Node(instance in=reference to "Aperture NPLC_TempThermis2w", "Visible"=FALSE)
        # TEMPMAIN VISIBILITY
        Property Node(instance in=reference to "Probe_TempMain", "Visible"=FALSE)
        Property Node(instance in=reference to "LowPower_TempRTD2w", "Visible"=FALSE)
        Property Node(instance in=reference to "OffstComp_TempRTD4w", "Visible"=FALSE)
        Property Node(instance in=reference to "Aperture Time_TempThermis4w", "Visible"=FALSE)
        Property Node(instance in=reference to "Aperture Time_TempThermis2w", "Visible"=FALSE)
        Property Node(instance in=reference to "OffstComp_TempRTD2w", "Visible"=FALSE)
        Property Node(instance in=reference to "R0_TempRTD4w", "Visible"=FALSE)
        Property Node(instance in=reference to "Aperture_TempThermis4w", "Visible"=FALSE)
        Property Node(instance in=reference to "Aperture_TempThermis2w", "Visible"=FALSE)
        Property Node(instance in=reference to "R0_TempRTD2w", "Visible"=FALSE)
        Property Node(instance in=reference to "Aperture NPLC_TempRTD4w", "Visible"=FALSE)
        Property Node(instance in=reference to "LowPower_TempThermis4w", "Visible"=FALSE)
        Property Node(instance in=reference to "Auto Zero_TempThermis2w", "Visible"=FALSE)
        Event Data() -> ("Old Value"=w22, "New Value"=w23)
        # EVENT NIE DLA
        # CONTROL NEW VALUE F
        # INDICATOR OLD
        Property Node(instance in=reference to "VoltageAC_indicator", "Visible"=w22)
        Property Node(instance in=reference to "Aperture NPLC_TempRTD2w", "Visible"=FALSE)
        Property Node(instance in=reference to "Aperture Time_TempRTD4w", "Visible"=FALSE)
        Property Node(instance in=reference to "Units_TempThermis4w", "Visible"=FALSE)
        Property Node(instance in=reference to "LowPower_TempThermis2w", "Visible"=FALSE)
        Property Node(instance in=reference to "CurrentDC_indicator", "Visible"=w22)
        Property Node(instance in=reference to "Aperture Time_TempRTD2w", "Visible"=FALSE)
        Property Node(instance in=reference to "Aperture_TempRTD4w", "Visible"=FALSE)
        Property Node(instance in=reference to "String_TempThermis4w", "Visible"=FALSE)
        Property Node(instance in=reference to "Units_TempThermis2w", "Visible"=FALSE)
        Property Node(instance in=reference to "CurrentAC_indicator", "Visible"=w22)
        Property Node(instance in=reference to "Aperture_TempRTD2w", "Visible"=FALSE)
        Property Node(instance in=reference to "Units_TempRTD4w", "Visible"=FALSE)
        Property Node(instance in=reference to "String_TempThermis2w", "Visible"=FALSE)
        Property Node(instance in=reference to "Units_TempRTD2w", "Visible"=FALSE)
        Property Node(instance in=reference to "2WResistance_indicator", "Visible"=w22)
        Property Node(instance in=reference to "String_TempRTD4w", "Visible"=FALSE)
        Property Node(instance in=reference to "String_TempRTD2w", "Visible"=FALSE)
        Property Node(instance in=reference to "4WResistance_indicator", "Visible"=w22)
        Property Node(instance in=reference to "Frequency_indicator", "Visible"=w22)
        Property Node(instance in=reference to "Capacitance_indicator", "Visible"=w22)
        Property Node(instance in=reference to "Continuity_indicator", "Visible"=w22)
        Property Node(instance in=reference to "VoltageDC_indicator", "Visible"=w22)
        Property Node(instance in=reference to "Temperature_indicator", "Visible"=w22)
        # EVENT DLA
        # CONTROL OLD
        # INDICATOR NEW
        Property Node(instance in=reference to "Diode_control", "Visible"=w22)
        Property Node(instance in=reference to "Diode_indicator", "Visible"=w23)
        Property Node(instance in=reference to "VoltageAC_control", "Visible"=w23, "Value"=FALSE)
        Property Node(instance in=reference to "CurrentDC_control", "Visible"=w23, "Value"=FALSE)
        Property Node(instance in=reference to "CurrentAC_control", "Visible"=w23, "Value"=FALSE)
        Property Node(instance in=reference to "2WResistance_control", "Visible"=w23, "Value"=FALSE)
        Property Node(instance in=reference to "4WResistance_control", "Visible"=w23, "Value"=FALSE)
        Property Node(instance in=reference to "Frequency_control", "Visible"=w23, "Value"=FALSE)
        Property Node(instance in=reference to "Capacitance_control", "Visible"=w23, "Value"=FALSE)
        Property Node(instance in=reference to "Continuity_control", "Visible"=w23, "Value"=FALSE)
        Property Node(instance in=reference to "VoltageDC_control", "Visible"=w23, "Value"=FALSE)
        Property Node(instance in=reference to "Temperature_control", "Visible"=w23, "Value"=FALSE)
        w1 = default
      }
      on "Temperature_control" Value changed {
        # TITLES VISIBILITY
        Property Node(instance in=reference to unnamed text, "Visible"=FALSE)
        # DCV VISIBILITY
        Property Node(instance in=reference to "DIG Option On/Off_DCV", "Visible"=FALSE)
        # DCC VISIBILITY
        Property Node(instance in=reference to "TerminalType_DCC", "Visible"=FALSE)
        # ACV VISIBILITY
        Property Node(instance in=reference to "Manual Range_ACV", "Visible"=FALSE)
        Property Node(instance in=reference to unnamed text, "Visible"=FALSE)
        # DCVRATIO VISIBILITY
        Property Node(instance in=reference to "DIG Option On/Off_DCVR", "Visible"=FALSE)
        # 2WR VISIBILITY
        Property Node(instance in=reference to "Aperture NPLC_2WR", "Visible"=FALSE)
        # 4WR VISIBILITY
        Property Node(instance in=reference to "Aperture NPLC_4WR", "Visible"=FALSE)
        Property Node(instance in=reference to "Auto Impedance_DCV", "Visible"=FALSE)
        # ACC VISIBILITY
        Property Node(instance in=reference to "TerminalType_ACC", "Visible"=FALSE)
        Property Node(instance in=reference to "Auto Range_DCC", "Visible"=FALSE)
        Property Node(instance in=reference to unnamed text, "Visible"=FALSE)
        Property Node(instance in=reference to "Auto Impedance_DCVR", "Visible"=FALSE)
        # FREQ VISIBILITY
        Property Node(instance in=reference to "ACFilter_Freq", "Visible"=FALSE)
        # CAPACI VISIBILITY
        Property Node(instance in=reference to "Manual Range_Capaci", "Visible"=FALSE)
        Property Node(instance in=reference to "VoltageBandwidth_ACV", "Visible"=FALSE)
        Property Node(instance in=reference to "Aperture Time_2WR", "Visible"=FALSE)
        Property Node(instance in=reference to "Aperture Time_4WR", "Visible"=FALSE)
        Property Node(instance in=reference to "Manual Range_DCV", "Visible"=FALSE, "Disabled"=TRUE)
        Property Node(instance in=reference to "VoltageBandwidth_ACC", "Visible"=FALSE)
        Property Node(instance in=reference to "Manual Range_DCC", "Visible"=FALSE)
        Property Node(instance in=reference to unnamed text, "Visible"=FALSE)
        Property Node(instance in=reference to "Manual Range_DCVR", "Visible"=FALSE)
        Property Node(instance in=reference to "Auto Range_Freq", "Visible"=FALSE)
        Property Node(instance in=reference to "Auto Range_Capaci", "Visible"=FALSE)
        Property Node(instance in=reference to "String_ACV", "Visible"=FALSE)
        Property Node(instance in=reference to "Aperture_2WR", "Visible"=FALSE)
        Property Node(instance in=reference to "Aperture_4WR", "Visible"=FALSE)
        Property Node(instance in=reference to "Aperture NPLC_DCV", "Visible"=FALSE)
        Property Node(instance in=reference to "Manual Range_ACC", "Visible"=FALSE)
        Property Node(instance in=reference to "Aperture_DCC", "Visible"=FALSE)
        Property Node(instance in=reference to "Aperture NPLC_DCVR", "Visible"=FALSE)
        Property Node(instance in=reference to "GateTime_Freq", "Visible"=FALSE)
        Property Node(instance in=reference to "String_Capaci", "Visible"=FALSE)
        Property Node(instance in=reference to unnamed text, "Visible"=FALSE)
        Property Node(instance in=reference to "Auto Range_ACV", "Visible"=FALSE)
        Property Node(instance in=reference to "Auto Range_2WR", "Visible"=FALSE)
        Property Node(instance in=reference to "Auto Range_4WR", "Visible"=FALSE)
        Property Node(instance in=reference to "Aperture_DCV", "Visible"=FALSE)
        Property Node(instance in=reference to "Auto Range_ACC", "Visible"=FALSE)
        Property Node(instance in=reference to "Aperture NPLC_DCC", "Visible"=FALSE)
        Property Node(instance in=reference to "Aperture_DCVR", "Visible"=FALSE)
        Property Node(instance in=reference to "Manual Range_Freq", "Visible"=FALSE)
        Property Node(instance in=reference to unnamed text, "Visible"=FALSE)
        Property Node(instance in=reference to "Auto Zero_2WR", "Visible"=FALSE)
        Property Node(instance in=reference to "LowPower_4WR", "Visible"=FALSE)
        Property Node(instance in=reference to "Auto Range_DCV", "Visible"=FALSE)
        Property Node(instance in=reference to "String_ACC", "Visible"=FALSE)
        Property Node(instance in=reference to "Aperture Time_DCC", "Visible"=FALSE)
        Property Node(instance in=reference to "Auto Range_DCVR", "Visible"=FALSE)
        Property Node(instance in=reference to "Timeout_Freq", "Visible"=FALSE)
        Property Node(instance in=reference to unnamed text, "Visible"=FALSE)
        Property Node(instance in=reference to "LowPower_2WR", "Visible"=FALSE)
        Property Node(instance in=reference to "Manual Range_4WR", "Visible"=FALSE)
        Property Node(instance in=reference to "DCV Ratio_toenable", "Visible"=FALSE)
        Property Node(instance in=reference to "Auto Zero_DCC", "Visible"=FALSE)
        Property Node(instance in=reference to "DCV Ratio_todisable", "Visible"=FALSE)
        Property Node(instance in=reference to "String_Freq", "Visible"=FALSE)
        Property Node(instance in=reference to unnamed text, "Visible"=FALSE)
        Property Node(instance in=reference to "Manual Range_2WR", "Visible"=FALSE)
        Property Node(instance in=reference to "OffstComp_4WR", "Visible"=FALSE)
        Property Node(instance in=reference to "Aperture Time_DCV", "Visible"=FALSE)
        Property Node(instance in=reference to "Aperture Time_DCVR", "Visible"=FALSE)
        Property Node(instance in=reference to unnamed text, "Visible"=FALSE)
        Property Node(instance in=reference to "String_DCC", "Visible"=FALSE)
        Property Node(instance in=reference to "OffstComp_2WR", "Visible"=FALSE)
        Property Node(instance in=reference to "String_4WR", "Visible"=FALSE)
        Property Node(instance in=reference to "String_DCV", "Visible"=FALSE)
        Property Node(instance in=reference to "String_DCVR", "Visible"=FALSE)
        Property Node(instance in=reference to unnamed text, "Visible"=FALSE)
        Property Node(instance in=reference to "String_2WR", "Visible"=FALSE)
        Property Node(instance in=reference to "Auto Zero_DCV", "Visible"=FALSE)
        Property Node(instance in=reference to unnamed text, "Visible"=FALSE)
        # CONT VISIBILITY
        Property Node(instance in=reference to "Beeper_Cont", "Visible"=FALSE)
        # DIODE VISIBILITY
        Property Node(instance in=reference to "Beeper_Diode", "Visible"=FALSE)
        Property Node(instance in=reference to unnamed text, "Visible"=FALSE)
        Property Node(instance in=reference to "String_Cont", "Visible"=FALSE)
        Property Node(instance in=reference to "String_Diode", "Visible"=FALSE)
        # TEMPRTD2W VISIBILITY
        Property Node(instance in=reference to "Auto Zero_TempRTD2w", "Visible"=FALSE)
        # TEMPRTD4W VISIBILITY
        Property Node(instance in=reference to "LowPower_TempRTD4w", "Visible"=TRUE)
        Property Node(instance in=reference to unnamed text, "Visible"=TRUE)
        # TEMPMAIN VISIBILITY
        Property Node(instance in=reference to "Probe_TempMain", "Visible"=TRUE, "Value"=1)
        # TEMPTHERMIS4W VISIBILITY
        Property Node(instance in=reference to "Aperture NPLC_TempThermis4w", "Visible"=FALSE)
        # TEMPTHERMIS2W VISIBILITY
        Property Node(instance in=reference to "Aperture NPLC_TempThermis2w", "Visible"=FALSE)
        Property Node(instance in=reference to "LowPower_TempRTD2w", "Visible"=FALSE)
        Property Node(instance in=reference to "OffstComp_TempRTD4w", "Visible"=TRUE)
        Property Node(instance in=reference to "Aperture Time_TempThermis4w", "Visible"=FALSE)
        Property Node(instance in=reference to "Aperture Time_TempThermis2w", "Visible"=FALSE)
        Property Node(instance in=reference to "OffstComp_TempRTD2w", "Visible"=FALSE)
        Property Node(instance in=reference to "R0_TempRTD4w", "Visible"=TRUE)
        Property Node(instance in=reference to "Aperture_TempThermis4w", "Visible"=FALSE)
        Property Node(instance in=reference to "Aperture_TempThermis2w", "Visible"=FALSE)
        Property Node(instance in=reference to "R0_TempRTD2w", "Visible"=FALSE)
        Property Node(instance in=reference to "Aperture NPLC_TempRTD4w", "Visible"=TRUE)
        Property Node(instance in=reference to "LowPower_TempThermis4w", "Visible"=FALSE)
        Property Node(instance in=reference to "Auto Zero_TempThermis2w", "Visible"=FALSE)
        Event Data() -> ("Old Value"=w24, "New Value"=w25)
        # EVENT NIE DLA
        # CONTROL NEW VALUE F
        # INDICATOR OLD
        Property Node(instance in=reference to "VoltageAC_indicator", "Visible"=w24)
        Property Node(instance in=reference to "Aperture NPLC_TempRTD2w", "Visible"=FALSE)
        Property Node(instance in=reference to "Aperture Time_TempRTD4w", "Visible"=TRUE)
        Property Node(instance in=reference to "Units_TempThermis4w", "Visible"=FALSE)
        Property Node(instance in=reference to "LowPower_TempThermis2w", "Visible"=FALSE)
        Property Node(instance in=reference to "Aperture Time_TempRTD2w", "Visible"=FALSE)
        Property Node(instance in=reference to "CurrentDC_indicator", "Visible"=w24)
        Property Node(instance in=reference to "Aperture_TempRTD4w", "Visible"=TRUE)
        Property Node(instance in=reference to "String_TempThermis4w", "Visible"=FALSE)
        Property Node(instance in=reference to "Units_TempThermis2w", "Visible"=FALSE)
        Property Node(instance in=reference to "Aperture_TempRTD2w", "Visible"=FALSE)
        Property Node(instance in=reference to "Units_TempRTD4w", "Visible"=TRUE)
        Property Node(instance in=reference to "CurrentAC_indicator", "Visible"=w24)
        Property Node(instance in=reference to "String_TempThermis2w", "Visible"=FALSE)
        Property Node(instance in=reference to "Units_TempRTD2w", "Visible"=FALSE)
        Property Node(instance in=reference to "String_TempRTD4w", "Visible"=TRUE)
        Property Node(instance in=reference to "2WResistance_indicator", "Visible"=w24)
        Property Node(instance in=reference to "String_TempRTD2w", "Visible"=FALSE)
        Property Node(instance in=reference to "4WResistance_indicator", "Visible"=w24)
        Property Node(instance in=reference to "Frequency_indicator", "Visible"=w24)
        Property Node(instance in=reference to "Capacitance_indicator", "Visible"=w24)
        Property Node(instance in=reference to "Continuity_indicator", "Visible"=w24)
        Property Node(instance in=reference to "Diode_indicator", "Visible"=w24)
        Property Node(instance in=reference to "VoltageDC_indicator", "Visible"=w24)
        # EVENT DLA
        # CONTROL OLD
        # INDICATOR NEW
        Property Node(instance in=reference to "Temperature_control", "Visible"=w24)
        Property Node(instance in=reference to "Temperature_indicator", "Visible"=w25)
        Property Node(instance in=reference to "VoltageAC_control", "Visible"=w25, "Value"=FALSE)
        Property Node(instance in=reference to "CurrentDC_control", "Visible"=w25, "Value"=FALSE)
        Property Node(instance in=reference to "CurrentAC_control", "Visible"=w25, "Value"=FALSE)
        Property Node(instance in=reference to "2WResistance_control", "Visible"=w25, "Value"=FALSE)
        Property Node(instance in=reference to "4WResistance_control", "Visible"=w25, "Value"=FALSE)
        Property Node(instance in=reference to "Frequency_control", "Visible"=w25, "Value"=FALSE)
        Property Node(instance in=reference to "Capacitance_control", "Visible"=w25, "Value"=FALSE)
        Property Node(instance in=reference to "Continuity_control", "Visible"=w25, "Value"=FALSE)
        Property Node(instance in=reference to "Diode_control", "Visible"=w25, "Value"=FALSE)
        Property Node(instance in=reference to "VoltageDC_control", "Visible"=w25, "Value"=FALSE)
        w1 = default
      }
      on "Aperture NPLC_DCV" Value changed; "Aperture Time_DCV" Value changed; "Aperture_DCV" Value changed; "Auto Impedance_DCV" Value changed; "Auto Range_DCV" Value changed; "Auto Zero_DCV" Value changed; "DIG Option On/Off_DCV" Value changed; "Manual Range_DCV" Value changed {
        Property Node(instance in=reference to "Aperture_DCV") -> ("Value"=w26)
        Property Node(instance in=reference to "DIG Option On/Off_DCV") -> ("Value"=w27)
        case (w27) {
          frame False, Default {
            w28 = [0, 1, 2]
          }
          frame True {
            w28 = i32[] []
          }
        }
        Not(x=w26) -> w29
        Property Node(instance in=reference to "Aperture NPLC_DCV", "Disabled"=w29, "DisabledIndexes"=w28) -> ("Value"=w30)
        case (w27) {
          frame False, Default {
            w31 = 0.0002
          }
          frame True {
            w31 = 2e-05
          }
        }
        Property Node(instance in=reference to "Aperture Time_DCV", "Disabled"=w26, "Minimum"=w31) -> ("Value"=w32)
        Quotient And Remainder(x=w32, y=2e-06) -> (floor(x/y)=w33, x-y*floor(x/y)=w34)
        Multiply(w34, 1000000) -> w35
        Round To Nearest(number=w35) -> w36
        To Signed 32 Bit Integer(number=w36) -> w37
        case (w37) {
          frame 0, Default {
            Multiply(2e-06, w33) -> w38
          }
          frame 1 {
            Multiply(2e-06, w33) -> w38
          }
          frame 2 {
            Add(1, w33) -> w39
            Multiply(2e-06, w39) -> w38
          }
        }
        case (w26) {
          frame False, Default {
            Format Into String(formatString="%_6ps", initString="Aperture Time: ", w38) -> w40
          }
          frame True {
            Format Into String(formatString="%#gPLC", initString="Aperture NPLC: ", w30) -> w40
          }
        }
        Property Node(instance in=reference to "Auto Range_DCV") -> ("Value"=w41)
        Property Node(instance in=reference to "Manual Range_DCV", "Disabled"=w41) -> ("Value"=w42)
        case (w41) {
          frame False, Default {
            Format Into String(formatString="%.0pV", initString="Range: ", w42) -> w43
          }
          frame True {
            w43 = "Range: Auto"
          }
        }
        Property Node(instance in=reference to "Auto Impedance_DCV") -> ("Value"=w44)
        case (w44) {
          frame False, Default {
            w45 = "Input Z: 10MΩ"
          }
          frame True {
            w45 = "Input Z: Auto"
          }
        }
        Property Node(instance in=reference to "Auto Zero_DCV") -> ("Value"=w46)
        case (w46) {
          frame False, Default {
            w47 = "Auto Zero: Off"
          }
          frame True {
            w47 = "Auto Zero: On"
          }
        }
        Concatenate Strings("Your settings:", "\r\n", w43, "\r\n", w40, "\r\n", w47, "\r\n", w45, "\r\n", "DCV Ratio: Off") -> w48
        $String_DCV <- w48
        Property Node(instance in=reference to "Aperture Time_DCV", "Value"=w38)
        w1 = default
      }
      on "Aperture NPLC_DCVR" Value changed; "Aperture Time_DCVR" Value changed; "Aperture_DCVR" Value changed; "Auto Impedance_DCVR" Value changed; "Auto Range_DCVR" Value changed; "DIG Option On/Off_DCVR" Value changed; "Manual Range_DCVR" Value changed {
        Property Node(instance in=reference to "Aperture_DCVR") -> ("Value"=w49)
        Property Node(instance in=reference to "DIG Option On/Off_DCVR") -> ("Value"=w50)
        case (w50) {
          frame False, Default {
            w51 = [0, 1, 2]
          }
          frame True {
            w51 = i32[] []
          }
        }
        Not(x=w49) -> w52
        Property Node(instance in=reference to "Aperture NPLC_DCVR", "Disabled"=w52, "DisabledIndexes"=w51) -> ("Value"=w53)
        case (w50) {
          frame False, Default {
            w54 = 0.0002
          }
          frame True {
            w54 = 2e-05
          }
        }
        Property Node(instance in=reference to "Aperture Time_DCVR", "Disabled"=w49, "Minimum"=w54) -> ("Value"=w55)
        Quotient And Remainder(x=w55, y=2e-06) -> (floor(x/y)=w56, x-y*floor(x/y)=w57)
        Multiply(w57, 1000000) -> w58
        Round To Nearest(number=w58) -> w59
        To Signed 32 Bit Integer(number=w59) -> w60
        case (w60) {
          frame 0, Default {
            Multiply(2e-06, w56) -> w61
          }
          frame 1 {
            Multiply(2e-06, w56) -> w61
          }
          frame 2 {
            Add(1, w56) -> w62
            Multiply(2e-06, w62) -> w61
          }
        }
        case (w49) {
          frame False, Default {
            Format Into String(formatString="%_6ps", initString="Aperture Time: ", w61) -> w63
          }
          frame True {
            Format Into String(formatString="%#gPLC", initString="Aperture NPLC: ", w53) -> w63
          }
        }
        Property Node(instance in=reference to "Auto Range_DCVR") -> ("Value"=w64)
        Property Node(instance in=reference to "Manual Range_DCVR", "Disabled"=w64) -> ("Value"=w65)
        case (w64) {
          frame False, Default {
            Format Into String(formatString="%.0pV", initString="Range: ", w65) -> w66
          }
          frame True {
            w66 = "Range: Auto"
          }
        }
        Property Node(instance in=reference to "Auto Impedance_DCVR") -> ("Value"=w67)
        case (w67) {
          frame False, Default {
            w68 = "Input Z: 10MΩ"
          }
          frame True {
            w68 = "Input Z: Auto"
          }
        }
        Concatenate Strings("Your settings:", "\r\n", w66, "\r\n", w63, "\r\n", "Auto Zero cannot be disabled during DCV Ratio", "\r\n", w68, "\r\n", "DCV Ratio: On") -> w69
        $String_DCVR <- w69
        Property Node(instance in=reference to "Aperture Time_DCVR", "Value"=w61)
        w1 = default
      }
      on "Auto Range_ACV" Value changed; "Manual Range_ACV" Value changed; "VoltageBandwidth_ACV" Value changed {
        Property Node(instance in=reference to "Auto Range_ACV") -> ("Value"=w70)
        Property Node(instance in=reference to "Manual Range_ACV", "Disabled"=w70) -> ("Value"=w71)
        case (w70) {
          frame False, Default {
            Format Into String(formatString="%.0pV", initString="Range: ", w71) -> w72
          }
          frame True {
            w72 = "Range: Auto"
          }
        }
        Property Node(instance in=reference to "VoltageBandwidth_ACV") -> ("Value"=w73)
        Format Into String(formatString="%.0pHz", initString="AC Filter: >", w73) -> w74
        Concatenate Strings("Your settings:", "\r\n", w72, "\r\n", w74) -> w75
        $String_ACV <- w75
        w1 = default
      }
      on "Aperture NPLC_DCC" Value changed; "Aperture Time_DCC" Value changed; "Aperture_DCC" Value changed; "Auto Range_DCC" Value changed; "Auto Zero_DCC" Value changed; "Manual Range_DCC" Value changed; "TerminalType_DCC" Value changed {
        Property Node(instance in=reference to "Aperture_DCC") -> ("Value"=w76)
        Not(x=w76) -> w77
        Property Node(instance in=reference to "Aperture NPLC_DCC", "Disabled"=w77) -> ("Value"=w78)
        Property Node(instance in=reference to "Aperture Time_DCC", "Disabled"=w76) -> ("Value"=w79)
        Quotient And Remainder(x=w79, y=2e-06) -> (floor(x/y)=w80, x-y*floor(x/y)=w81)
        Multiply(w81, 1000000) -> w82
        Round To Nearest(number=w82) -> w83
        To Signed 32 Bit Integer(number=w83) -> w84
        case (w84) {
          frame 0, Default {
            Multiply(2e-06, w80) -> w85
          }
          frame 1 {
            Multiply(2e-06, w80) -> w85
          }
          frame 2 {
            Add(1, w80) -> w86
            Multiply(2e-06, w86) -> w85
          }
        }
        case (w76) {
          frame False, Default {
            Format Into String(formatString="%_6ps", initString="Aperture Time: ", w85) -> w87
          }
          frame True {
            Format Into String(formatString="%#gPLC", initString="Aperture NPLC: ", w78) -> w87
          }
        }
        Property Node(instance in=reference to "Auto Range_DCC") -> ("Value"=w88)
        Property Node(instance in=reference to "Manual Range_DCC", "Disabled"=w88) -> ("Value"=w89)
        case (w88) {
          frame False, Default {
            Format Into String(formatString="%.0pA", initString="Range: ", w89) -> w90
          }
          frame True {
            w90 = "Range: Auto"
          }
        }
        Property Node(instance in=reference to "Auto Zero_DCC") -> ("Value"=w91)
        case (w91) {
          frame False, Default {
            w92 = "Auto Zero: Off"
          }
          frame True {
            w92 = "Auto Zero: On"
          }
        }
        Property Node(instance in=reference to "TerminalType_DCC") -> ("Value"=w93)
        Format Into String(formatString="%.0pA", initString="Terminal: ", w93) -> w94
        Concatenate Strings("Your settings:", "\r\n", w90, "\r\n", w87, "\r\n", w94, "\r\n", w92) -> w95
        $String_DCC <- w95
        Property Node(instance in=reference to "Aperture Time_DCC", "Value"=w85)
        w1 = default
      }
      on "Auto Range_ACC" Value changed; "Manual Range_ACC" Value changed; "TerminalType_ACC" Value changed; "VoltageBandwidth_ACC" Value changed {
        Property Node(instance in=reference to "Auto Range_ACC") -> ("Value"=w96)
        Property Node(instance in=reference to "Manual Range_ACC", "Disabled"=w96) -> ("Value"=w97)
        case (w96) {
          frame False, Default {
            Format Into String(formatString="%.0pA", initString="Range: ", w97) -> w98
          }
          frame True {
            w98 = "Range: Auto"
          }
        }
        Property Node(instance in=reference to "VoltageBandwidth_ACC") -> ("Value"=w99)
        Format Into String(formatString="%.0pHz", initString="AC Filter: >", w99) -> w100
        Property Node(instance in=reference to "TerminalType_ACC") -> ("Value"=w101)
        Format Into String(formatString="%.0pA", initString="Terminal: ", w101) -> w102
        Concatenate Strings("Your settings:", "\r\n", w98, "\r\n", w100, "\r\n", w102) -> w103
        $String_ACC <- w103
        w1 = default
      }
      on "Aperture NPLC_2WR" Value changed; "Aperture Time_2WR" Value changed; "Aperture_2WR" Value changed; "Auto Range_2WR" Value changed; "Auto Zero_2WR" Value changed; "LowPower_2WR" Value changed; "Manual Range_2WR" Value changed; "OffstComp_2WR" Value changed {
        Property Node(instance in=reference to "Aperture_2WR") -> ("Value"=w104)
        Not(x=w104) -> w105
        Property Node(instance in=reference to "Aperture NPLC_2WR", "Disabled"=w105) -> ("Value"=w106)
        Property Node(instance in=reference to "Aperture Time_2WR", "Disabled"=w104) -> ("Value"=w107)
        Quotient And Remainder(x=w107, y=2e-06) -> (floor(x/y)=w108, x-y*floor(x/y)=w109)
        Multiply(w109, 1000000) -> w110
        Round To Nearest(number=w110) -> w111
        To Signed 32 Bit Integer(number=w111) -> w112
        case (w112) {
          frame 0, Default {
            Multiply(2e-06, w108) -> w113
          }
          frame 1 {
            Multiply(2e-06, w108) -> w113
          }
          frame 2 {
            Add(1, w108) -> w114
            Multiply(2e-06, w114) -> w113
          }
        }
        case (w104) {
          frame False, Default {
            Format Into String(formatString="%_6ps", initString="Aperture Time: ", w113) -> w115
          }
          frame True {
            Format Into String(formatString="%#gPLC", initString="Aperture NPLC: ", w106) -> w115
          }
        }
        Property Node(instance in=reference to "OffstComp_2WR") -> ("Value"=w116)
        case (w116) {
          frame False, Default {
            w117 = "Offset Compensation: Off"
          }
          frame True {
            w117 = "Offset Compensation: On"
          }
        }
        Property Node(instance in=reference to "Auto Range_2WR") -> ("Value"=w118)
        Property Node(instance in=reference to "Manual Range_2WR", "Disabled"=w118) -> ("Value"=w119)
        case (w118) {
          frame False, Default {
            Format Into String(formatString="%.0pΩ", initString="Range: ", w119) -> w120
          }
          frame True {
            w120 = "Range: Auto"
          }
        }
        Property Node(instance in=reference to "LowPower_2WR") -> ("Value"=w121)
        case (w121) {
          frame False, Default {
            w122 = "Low Power: Off"
          }
          frame True {
            w122 = "Low Power: On"
          }
        }
        Property Node(instance in=reference to "Auto Zero_2WR") -> ("Value"=w123)
        case (w123) {
          frame False, Default {
            w124 = "Auto Zero: Off"
          }
          frame True {
            w124 = "Auto Zero: On"
          }
        }
        Concatenate Strings("Your settings:", "\r\n", w120, "\r\n", w115, "\r\n", w124, "\r\n", w122, "\r\n", w117) -> w125
        $String_2WR <- w125
        Property Node(instance in=reference to "Aperture Time_2WR", "Value"=w113)
        w1 = default
      }
      on "Aperture NPLC_4WR" Value changed; "Aperture Time_4WR" Value changed; "Aperture_4WR" Value changed; "Auto Range_4WR" Value changed; "LowPower_4WR" Value changed; "Manual Range_4WR" Value changed; "OffstComp_4WR" Value changed {
        Property Node(instance in=reference to "Aperture_4WR") -> ("Value"=w126)
        Not(x=w126) -> w127
        Property Node(instance in=reference to "Aperture NPLC_4WR", "Disabled"=w127) -> ("Value"=w128)
        Property Node(instance in=reference to "Aperture Time_4WR", "Disabled"=w126) -> ("Value"=w129)
        Quotient And Remainder(x=w129, y=2e-06) -> (floor(x/y)=w130, x-y*floor(x/y)=w131)
        Multiply(w131, 1000000) -> w132
        Round To Nearest(number=w132) -> w133
        To Signed 32 Bit Integer(number=w133) -> w134
        case (w134) {
          frame 0, Default {
            Multiply(2e-06, w130) -> w135
          }
          frame 1 {
            Multiply(2e-06, w130) -> w135
          }
          frame 2 {
            Add(1, w130) -> w136
            Multiply(2e-06, w136) -> w135
          }
        }
        case (w126) {
          frame False, Default {
            Format Into String(formatString="%_6ps", initString="Aperture Time: ", w135) -> w137
          }
          frame True {
            Format Into String(formatString="%#gPLC", initString="Aperture NPLC: ", w128) -> w137
          }
        }
        Property Node(instance in=reference to "OffstComp_4WR") -> ("Value"=w138)
        case (w138) {
          frame False, Default {
            w139 = "Offset Compensation: Off"
          }
          frame True {
            w139 = "Offset Compensation: On"
          }
        }
        Property Node(instance in=reference to "Auto Range_4WR") -> ("Value"=w140)
        Property Node(instance in=reference to "Manual Range_4WR", "Disabled"=w140) -> ("Value"=w141)
        case (w140) {
          frame False, Default {
            Format Into String(formatString="%.0pΩ", initString="Range: ", w141) -> w142
          }
          frame True {
            w142 = "Range: Auto"
          }
        }
        Property Node(instance in=reference to "LowPower_4WR") -> ("Value"=w143)
        case (w143) {
          frame False, Default {
            w144 = "Low Power: Off"
          }
          frame True {
            w144 = "Low Power: On"
          }
        }
        Concatenate Strings("Your settings:", "\r\n", w142, "\r\n", w137, "\r\n", "Auto Zero cannot be disabled", "\r\n", w144, "\r\n", w139) -> w145
        $String_4WR <- w145
        Property Node(instance in=reference to "Aperture Time_4WR", "Value"=w135)
        w1 = default
      }
      on "ACFilter_Freq" Value changed; "Auto Range_Freq" Value changed; "GateTime_Freq" Value changed; "Manual Range_Freq" Value changed; "Timeout_Freq" Value changed {
        Property Node(instance in=reference to "Auto Range_Freq") -> ("Value"=w146)
        Property Node(instance in=reference to "Manual Range_Freq", "Disabled"=w146) -> ("Value"=w147)
        case (w146) {
          frame False, Default {
            Format Into String(formatString="%.0pV", initString="Range: ", w147) -> w148
          }
          frame True {
            w148 = "Range: Auto"
          }
        }
        Property Node(instance in=reference to "ACFilter_Freq") -> ("Value"=w149)
        Format Into String(formatString="%.0pHz", initString="AC Filter: >", w149) -> w150
        Property Node(instance in=reference to "GateTime_Freq") -> ("Value"=w151)
        Format Into String(formatString="%.0ps", initString="Gate Time: ", w151) -> w152
        Property Node(instance in=reference to "Timeout_Freq") -> ("Value"=w153)
        case (w153) {
          frame False, Default {
            w154 = "Timeout: 1s"
          }
          frame True {
            w154 = "Timeout: Auto"
          }
        }
        Concatenate Strings("Your settings:", "\r\n", w148, "\r\n", w150, "\r\n", w152, "\r\n", w154) -> w155
        $String_Freq <- w155
        w1 = default
      }
      on "Auto Range_Capaci" Value changed; "Manual Range_Capaci" Value changed {
        Property Node(instance in=reference to "Auto Range_Capaci") -> ("Value"=w156)
        Property Node(instance in=reference to "Manual Range_Capaci", "Disabled"=w156) -> ("Value"=w157)
        case (w156) {
          frame False, Default {
            Format Into String(formatString="%.0pF", initString="Range: ", w157) -> w158
          }
          frame True {
            w158 = "Range: Auto"
          }
        }
        Concatenate Strings("Your settings:", "\r\n", w158) -> w159
        $String_Capaci <- w159
        w1 = default
      }
      on "Beeper_Cont" Value changed {
        Property Node(instance in=reference to "Beeper_Cont") -> ("Value"=w160)
        case (w160) {
          frame False, Default {
            w161 = "Beeper: Off"
          }
          frame True {
            w161 = "Beeper: On"
          }
        }
        Concatenate Strings("Your settings:", "\r\n", w161) -> w162
        $String_Cont <- w162
        w1 = default
      }
      on "Beeper_Diode" Value changed {
        Property Node(instance in=reference to "Beeper_Diode") -> ("Value"=w163)
        case (w163) {
          frame False, Default {
            w164 = "Beeper: Off"
          }
          frame True {
            w164 = "Beeper: On"
          }
        }
        Concatenate Strings("Your settings:", "\r\n", w164) -> w165
        $String_Diode <- w165
        w1 = default
      }
      on "Probe_TempMain" Value changed {
        Event Data() -> ("Old Value"=w166, "New Value"=w167)
        case (w166) {
          frame 0, Default {
            # TEMPRTD2W VISIBILITY
            Property Node(instance in=reference to "Auto Zero_TempRTD2w", "Visible"=FALSE)
            Property Node(instance in=reference to "LowPower_TempRTD2w", "Visible"=FALSE)
            Property Node(instance in=reference to "OffstComp_TempRTD2w", "Visible"=FALSE)
            Property Node(instance in=reference to "R0_TempRTD2w", "Visible"=FALSE)
            Property Node(instance in=reference to "Aperture NPLC_TempRTD2w", "Visible"=FALSE)
            Property Node(instance in=reference to "Aperture Time_TempRTD2w", "Visible"=FALSE)
            Property Node(instance in=reference to "Aperture_TempRTD2w", "Visible"=FALSE)
            Property Node(instance in=reference to "Units_TempRTD2w", "Visible"=FALSE)
            Property Node(instance in=reference to "String_TempRTD2w", "Visible"=FALSE)
          }
          frame 1 {
            # TEMPRTD4W VISIBILITY
            Property Node(instance in=reference to "LowPower_TempRTD4w", "Visible"=FALSE)
            Property Node(instance in=reference to "OffstComp_TempRTD4w", "Visible"=FALSE)
            Property Node(instance in=reference to "R0_TempRTD4w", "Visible"=FALSE)
            Property Node(instance in=reference to "Aperture NPLC_TempRTD4w", "Visible"=FALSE)
            Property Node(instance in=reference to "Aperture Time_TempRTD4w", "Visible"=FALSE)
            Property Node(instance in=reference to "Aperture_TempRTD4w", "Visible"=FALSE)
            Property Node(instance in=reference to "Units_TempRTD4w", "Visible"=FALSE)
            Property Node(instance in=reference to "String_TempRTD4w", "Visible"=FALSE)
          }
          frame 2 {
            # TEMPTHERMIS2W VISIBILITY
            Property Node(instance in=reference to "Aperture NPLC_TempThermis2w", "Visible"=FALSE)
            Property Node(instance in=reference to "Aperture Time_TempThermis2w", "Visible"=FALSE)
            Property Node(instance in=reference to "Aperture_TempThermis2w", "Visible"=FALSE)
            Property Node(instance in=reference to "Auto Zero_TempThermis2w", "Visible"=FALSE)
            Property Node(instance in=reference to "LowPower_TempThermis2w", "Visible"=FALSE)
            Property Node(instance in=reference to "Units_TempThermis2w", "Visible"=FALSE)
            Property Node(instance in=reference to "String_TempThermis2w", "Visible"=FALSE)
          }
          frame 3 {
            # TEMPTHERMIS4W VISIBILITY
            Property Node(instance in=reference to "Aperture NPLC_TempThermis4w", "Visible"=FALSE)
            Property Node(instance in=reference to "Aperture Time_TempThermis4w", "Visible"=FALSE)
            Property Node(instance in=reference to "Aperture_TempThermis4w", "Visible"=FALSE)
            Property Node(instance in=reference to "LowPower_TempThermis4w", "Visible"=FALSE)
            Property Node(instance in=reference to "Units_TempThermis4w", "Visible"=FALSE)
            Property Node(instance in=reference to "String_TempThermis4w", "Visible"=FALSE)
          }
        }
        case (w167) {
          frame 0, Default {
            # TEMPRTD2W VISIBILITY
            Property Node(instance in=reference to "Auto Zero_TempRTD2w", "Visible"=TRUE)
            Property Node(instance in=reference to "LowPower_TempRTD2w", "Visible"=TRUE)
            Property Node(instance in=reference to "OffstComp_TempRTD2w", "Visible"=TRUE)
            Property Node(instance in=reference to "R0_TempRTD2w", "Visible"=TRUE)
            Property Node(instance in=reference to "Aperture NPLC_TempRTD2w", "Visible"=TRUE)
            Property Node(instance in=reference to "Aperture Time_TempRTD2w", "Visible"=TRUE)
            Property Node(instance in=reference to "Aperture_TempRTD2w", "Visible"=TRUE)
            Property Node(instance in=reference to "Units_TempRTD2w", "Visible"=TRUE)
            Property Node(instance in=reference to "String_TempRTD2w", "Visible"=TRUE)
          }
          frame 1 {
            # TEMPRTD4W VISIBILITY
            Property Node(instance in=reference to "LowPower_TempRTD4w", "Visible"=TRUE)
            Property Node(instance in=reference to "OffstComp_TempRTD4w", "Visible"=TRUE)
            Property Node(instance in=reference to "R0_TempRTD4w", "Visible"=TRUE)
            Property Node(instance in=reference to "Aperture NPLC_TempRTD4w", "Visible"=TRUE)
            Property Node(instance in=reference to "Aperture Time_TempRTD4w", "Visible"=TRUE)
            Property Node(instance in=reference to "Aperture_TempRTD4w", "Visible"=TRUE)
            Property Node(instance in=reference to "Units_TempRTD4w", "Visible"=TRUE)
            Property Node(instance in=reference to "String_TempRTD4w", "Visible"=TRUE)
          }
          frame 2 {
            # TEMPTHERMIS2W VISIBILITY
            Property Node(instance in=reference to "Aperture NPLC_TempThermis2w", "Visible"=TRUE)
            Property Node(instance in=reference to "Aperture Time_TempThermis2w", "Visible"=TRUE)
            Property Node(instance in=reference to "Aperture_TempThermis2w", "Visible"=TRUE)
            Property Node(instance in=reference to "Auto Zero_TempThermis2w", "Visible"=TRUE)
            Property Node(instance in=reference to "LowPower_TempThermis2w", "Visible"=TRUE)
            Property Node(instance in=reference to "Units_TempThermis2w", "Visible"=TRUE)
            Property Node(instance in=reference to "String_TempThermis2w", "Visible"=TRUE)
          }
          frame 3 {
            # TEMPTHERMIS4W VISIBILITY
            Property Node(instance in=reference to "Aperture NPLC_TempThermis4w", "Visible"=TRUE)
            Property Node(instance in=reference to "Aperture Time_TempThermis4w", "Visible"=TRUE)
            Property Node(instance in=reference to "Aperture_TempThermis4w", "Visible"=TRUE)
            Property Node(instance in=reference to "LowPower_TempThermis4w", "Visible"=TRUE)
            Property Node(instance in=reference to "Units_TempThermis4w", "Visible"=TRUE)
            Property Node(instance in=reference to "String_TempThermis4w", "Visible"=TRUE)
          }
        }
        w1 = default
      }
      on "Aperture NPLC_TempRTD4w" Value changed; "Aperture Time_TempRTD4w" Value changed; "Aperture_TempRTD4w" Value changed; "LowPower_TempRTD4w" Value changed; "OffstComp_TempRTD4w" Value changed; "R0_TempRTD4w" Value changed; "Units_TempRTD4w" Value changed {
        Property Node(instance in=reference to "Aperture_TempRTD4w") -> ("Value"=w168)
        Not(x=w168) -> w169
        Property Node(instance in=reference to "Aperture NPLC_TempRTD4w", "Disabled"=w169) -> ("Value"=w170)
        Property Node(instance in=reference to "Aperture Time_TempRTD4w", "Disabled"=w168) -> ("Value"=w171)
        Quotient And Remainder(x=w171, y=2e-06) -> (floor(x/y)=w172, x-y*floor(x/y)=w173)
        Multiply(w173, 1000000) -> w174
        Round To Nearest(number=w174) -> w175
        To Signed 32 Bit Integer(number=w175) -> w176
        case (w176) {
          frame 0, Default {
            Multiply(2e-06, w172) -> w177
          }
          frame 1 {
            Multiply(2e-06, w172) -> w177
          }
          frame 2 {
            Add(1, w172) -> w178
            Multiply(2e-06, w178) -> w177
          }
        }
        case (w168) {
          frame False, Default {
            Format Into String(formatString="%_6ps", initString="Aperture Time: ", w177) -> w179
          }
          frame True {
            Format Into String(formatString="%#gPLC", initString="Aperture NPLC: ", w170) -> w179
          }
        }
        Property Node(instance in=reference to "OffstComp_TempRTD4w") -> ("Value"=w180)
        case (w180) {
          frame False, Default {
            w181 = "OffstComp: Off "
          }
          frame True {
            w181 = "OffstComp: On"
          }
        }
        Property Node(instance in=reference to "Units_TempRTD4w") -> ("Value"=w182)
        case (w182) {
          frame 0, Default {
            w183 = "Units: °C"
          }
          frame 1 {
            w183 = "Units: K"
          }
          frame 2 {
            w183 = "Units: °F"
          }
        }
        Property Node(instance in=reference to "LowPower_TempRTD4w") -> ("Value"=w184)
        case (w184) {
          frame False, Default {
            w185 = "Low Power: Off"
          }
          frame True {
            w185 = "Low Power: On"
          }
        }
        Property Node(instance in=reference to "R0_TempRTD4w") -> ("Value"=w186)
        Format Into String(formatString="%_6ps", initString="R0: ", w186) -> w187
        Concatenate Strings("Your settings:", "\r\n", w181, "\r\n", w179, "\r\n", w183, "\r\n", w185, "\r\n", w187) -> w188
        $String_TempRTD4w <- w188
        Property Node(instance in=reference to "Aperture Time_TempRTD4w", "Value"=w177)
        w1 = default
      }
      on "Aperture NPLC_TempRTD2w" Value changed; "Aperture Time_TempRTD2w" Value changed; "Aperture_TempRTD2w" Value changed; "Auto Zero_TempRTD2w" Value changed; "LowPower_TempRTD2w" Value changed; "OffstComp_TempRTD2w" Value changed; "R0_TempRTD2w" Value changed; "Units_TempRTD2w" Value changed {
        Property Node(instance in=reference to "Aperture_TempRTD2w") -> ("Value"=w189)
        Not(x=w189) -> w190
        Property Node(instance in=reference to "Aperture NPLC_TempRTD2w", "Disabled"=w190) -> ("Value"=w191)
        Property Node(instance in=reference to "Aperture Time_TempRTD2w", "Disabled"=w189) -> ("Value"=w192)
        Quotient And Remainder(x=w192, y=2e-06) -> (floor(x/y)=w193, x-y*floor(x/y)=w194)
        Multiply(w194, 1000000) -> w195
        Round To Nearest(number=w195) -> w196
        To Signed 32 Bit Integer(number=w196) -> w197
        case (w197) {
          frame 0, Default {
            Multiply(2e-06, w193) -> w198
          }
          frame 1 {
            Multiply(2e-06, w193) -> w198
          }
          frame 2 {
            Add(1, w193) -> w199
            Multiply(2e-06, w199) -> w198
          }
        }
        case (w189) {
          frame False, Default {
            Format Into String(formatString="%_6ps", initString="Aperture Time: ", w198) -> w200
          }
          frame True {
            Format Into String(formatString="%#gPLC", initString="Aperture NPLC: ", w191) -> w200
          }
        }
        Property Node(instance in=reference to "OffstComp_TempRTD2w") -> ("Value"=w201)
        case (w201) {
          frame False, Default {
            w202 = "OffstComp: Off "
          }
          frame True {
            w202 = "OffstComp: On"
          }
        }
        Property Node(instance in=reference to "R0_TempRTD2w") -> ("Value"=w203)
        Format Into String(formatString="%_6ps", initString="R0: ", w203) -> w204
        Property Node(instance in=reference to "Units_TempRTD2w") -> ("Value"=w205)
        case (w205) {
          frame 0, Default {
            w206 = "Units: °C"
          }
          frame 1 {
            w206 = "Units: K"
          }
          frame 2 {
            w206 = "Units: °F"
          }
        }
        Property Node(instance in=reference to "LowPower_TempRTD2w") -> ("Value"=w207)
        case (w207) {
          frame False, Default {
            w208 = "Low Power: Off"
          }
          frame True {
            w208 = "Low Power: On"
          }
        }
        Property Node(instance in=reference to "Auto Zero_TempRTD2w") -> ("Value"=w209)
        case (w209) {
          frame False, Default {
            w210 = "Auto Zero: Off"
          }
          frame True {
            w210 = "Auto Zero: On"
          }
        }
        Concatenate Strings("Your settings:", "\r\n", w202, "\r\n", w200, "\r\n", w206, "\r\n", w208, "\r\n", w210, "\r\n", w204) -> w211
        $String_TempRTD2w <- w211
        Property Node(instance in=reference to "Aperture Time_TempRTD2w", "Value"=w198)
        w1 = default
      }
      on "Aperture NPLC_TempThermis4w" Value changed; "Aperture Time_TempThermis4w" Value changed; "Aperture_TempThermis4w" Value changed; "LowPower_TempThermis4w" Value changed; "Units_TempThermis4w" Value changed {
        Property Node(instance in=reference to "Aperture_TempThermis4w") -> ("Value"=w212)
        Not(x=w212) -> w213
        Property Node(instance in=reference to "Aperture NPLC_TempThermis4w", "Disabled"=w213) -> ("Value"=w214)
        Property Node(instance in=reference to "Aperture Time_TempThermis4w", "Disabled"=w212) -> ("Value"=w215)
        Quotient And Remainder(x=w215, y=2e-06) -> (floor(x/y)=w216, x-y*floor(x/y)=w217)
        Multiply(w217, 1000000) -> w218
        Round To Nearest(number=w218) -> w219
        To Signed 32 Bit Integer(number=w219) -> w220
        case (w220) {
          frame 0, Default {
            Multiply(2e-06, w216) -> w221
          }
          frame 1 {
            Multiply(2e-06, w216) -> w221
          }
          frame 2 {
            Add(1, w216) -> w222
            Multiply(2e-06, w222) -> w221
          }
        }
        case (w212) {
          frame False, Default {
            Format Into String(formatString="%_6ps", initString="Aperture Time: ", w221) -> w223
          }
          frame True {
            Format Into String(formatString="%#gPLC", initString="Aperture NPLC: ", w214) -> w223
          }
        }
        Property Node(instance in=reference to "Units_TempThermis4w") -> ("Value"=w224)
        case (w224) {
          frame 0, Default {
            w225 = "Units: °C"
          }
          frame 1 {
            w225 = "Units: K"
          }
          frame 2 {
            w225 = "Units: °F"
          }
        }
        Property Node(instance in=reference to "LowPower_TempThermis4w") -> ("Value"=w226)
        case (w226) {
          frame False, Default {
            w227 = "Low Power: Off"
          }
          frame True {
            w227 = "Low Power: On"
          }
        }
        Concatenate Strings("Your settings:", "\r\n", w223, "\r\n", w225, "\r\n", w227) -> w228
        $String_TempThermis4w <- w228
        Property Node(instance in=reference to "Aperture Time_TempThermis4w", "Value"=w221)
        w1 = default
      }
      on "Aperture NPLC_TempThermis2w" Value changed; "Aperture Time_TempThermis2w" Value changed; "Aperture_TempThermis2w" Value changed; "Auto Zero_TempThermis2w" Value changed; "LowPower_TempThermis2w" Value changed; "Units_TempThermis2w" Value changed {
        Property Node(instance in=reference to "Aperture_TempThermis2w") -> ("Value"=w229)
        Not(x=w229) -> w230
        Property Node(instance in=reference to "Aperture NPLC_TempThermis2w", "Disabled"=w230) -> ("Value"=w231)
        Property Node(instance in=reference to "Aperture Time_TempThermis2w", "Disabled"=w229) -> ("Value"=w232)
        Quotient And Remainder(x=w232, y=2e-06) -> (floor(x/y)=w233, x-y*floor(x/y)=w234)
        Multiply(w234, 1000000) -> w235
        Round To Nearest(number=w235) -> w236
        To Signed 32 Bit Integer(number=w236) -> w237
        case (w237) {
          frame 0, Default {
            Multiply(2e-06, w233) -> w238
          }
          frame 1 {
            Multiply(2e-06, w233) -> w238
          }
          frame 2 {
            Add(1, w233) -> w239
            Multiply(2e-06, w239) -> w238
          }
        }
        case (w229) {
          frame False, Default {
            Format Into String(formatString="%_6ps", initString="Aperture Time: ", w238) -> w240
          }
          frame True {
            Format Into String(formatString="%#gPLC", initString="Aperture NPLC: ", w231) -> w240
          }
        }
        Property Node(instance in=reference to "Units_TempThermis2w") -> ("Value"=w241)
        case (w241) {
          frame 0, Default {
            w242 = "Units: °C"
          }
          frame 1 {
            w242 = "Units: K"
          }
          frame 2 {
            w242 = "Units: °F"
          }
        }
        Property Node(instance in=reference to "LowPower_TempThermis2w") -> ("Value"=w243)
        case (w243) {
          frame False, Default {
            w244 = "Low Power: Off"
          }
          frame True {
            w244 = "Low Power: On"
          }
        }
        Property Node(instance in=reference to "Auto Zero_TempThermis2w") -> ("Value"=w245)
        case (w245) {
          frame False, Default {
            w246 = "Auto Zero: Off"
          }
          frame True {
            w246 = "Auto Zero: On"
          }
        }
        Concatenate Strings("Your settings:", "\r\n", w240, "\r\n", w242, "\r\n", w244, "\r\n", w246) -> w247
        $String_TempThermis2w <- w247
        Property Node(instance in=reference to "Aperture Time_TempThermis2w", "Value"=w238)
        w1 = default
      }
      on "stop" Value changed; "Window" Close {
        w1 = TRUE
      }
    }
    # DCC CONTROLS/INDICATORS
    # ACC CONTROLS/INDICATORS
    # MAIN CONTROLS/INDICATORS
    $VoltageDC_indicator <- $VoltageDC_control
    # DCV CONTROLS/INDICATORS
    # DCVR CONTROLS/INDICATORS
    # CAPACI CONTROLS/INDICATORS
    # CONT CONTROLS/INDICATORS
    # DIODE CONTROLS/INDICATORS
    # TEMPPROBE CONTROL
    # TEMPRTD4W CONTROLS/INDICATORS
    # TEMPRTD2W CONTROLS/INDICATORS
    # TEMPTHERMIS4W CONTROLS/INDICATORS
    # TEMPTHERMIS2W CONTROLS/INDICATORS
    $VoltageAC_indicator <- $VoltageAC_control
    $CurrentDC_indicator <- $CurrentDC_control
    $CurrentAC_indicator <- $CurrentAC_control
    $"2WResistance_indicator" <- $"2WResistance_control"
    $"4WResistance_indicator" <- $"4WResistance_control"
    $Frequency_indicator <- $Frequency_control
    $Capacitance_indicator <- $Capacitance_control
    $Continuity_indicator <- $Continuity_control
    $Diode_indicator <- $Diode_control
    $Temperature_indicator <- $Temperature_control
    stop if w1
  }
  Property Node(instance in=reference to unnamed text, "Visible"=FALSE)
  Property Node(instance in=reference to unnamed text, "Visible"=FALSE)
  Property Node(instance in=reference to unnamed text, "Visible"=FALSE)
  Property Node(instance in=reference to unnamed text, "Visible"=FALSE)
  Property Node(instance in=reference to unnamed text, "Visible"=FALSE)
  Property Node(instance in=reference to unnamed text, "Visible"=FALSE)
  Property Node(instance in=reference to unnamed text, "Visible"=FALSE)
  Property Node(instance in=reference to unnamed text, "Visible"=FALSE)
  Property Node(instance in=reference to unnamed text, "Visible"=FALSE)

